# Grasshopper definition AMCAD-Phase4_forCodex.ghx (Grasshopper 1.0.8)

path = FilePath("C:\Users\ookan\Documents\CATIA\TT920.06.307103.AC.stp")
py3 = Python3Script(Geometry=path, Positioning=Button())  # -> OriginalManifold
# ---------- py3: Python ----------
"""AMCAD Geometry Positioning | Rhino 8 Grasshopper Python 3.
Inputs: Geometry (STEP file path, Item), Positioning (Button, Item)
Output: OriginalManifold (Brep or list of Breps)
"""
import os
import Rhino
import Rhino.Geometry as rg
import scriptcontext as sc
import Eto.Forms as forms
import Eto.Drawing as drawing

OriginalManifold = None

# Each component instance has its own persistent state.
component_id = str(ghenv.Component.InstanceGuid)
key = 'AMCAD_STEP_POSITION_' + component_id
state = sc.sticky.get(key)
if state is None:
    state = {'path': None, 'stamp': None, 'geometry': [],
             'xyzr': [0.0] * 6, 'button_previous': False, 'message': ''}
    sc.sticky[key] = state


def log(msg):
    state['message'] = str(msg)
    try:
        ghenv.Component.Message = str(msg)[:65]
    except Exception:
        pass


def get_path(value):
    if value is None:
        return ''
    p = str(value).strip().strip('"')
    return os.path.abspath(os.path.expanduser(p)) if p else ''


def load_step(path):
    """Import STEP using Rhino importer, duplicate imported Breps, remove only new objects.
    Note: this uses Rhino's command importer and therefore runs in the active Rhino document.
    """
    doc = Rhino.RhinoDoc.ActiveDoc
    if doc is None:
        raise RuntimeError('No active Rhino document')
    before = set(str(o.Id) for o in doc.Objects)
    # Do not allow command injection from file names.
    if '\n' in path or '\r' in path or '"' in path:
        raise ValueError('Unsupported quote/newline in STEP path')
    command = '_-Import "{}" _Enter'.format(path)
    ok = False
    created = []
    try:
        ok = Rhino.RhinoApp.RunScript(command, False)
        created = [o for o in doc.Objects if str(o.Id) not in before]
        if not ok:
            raise RuntimeError('Rhino STEP importer failed; check Rhino command history')
        breps = []
        for obj in created:
            geo = obj.Geometry
            if isinstance(geo, rg.Brep):
                breps.append(geo.DuplicateBrep())
            elif isinstance(geo, rg.Extrusion):
                breps.append(geo.ToBrep())
        if not breps:
            raise RuntimeError('Imported STEP contains no Brep/Extrusion solids')
        return breps
    finally:
        # Only remove objects created during this import, never preexisting Rhino objects.
        # If the importer failed, still clean any partially imported geometry.
        if not created:
            created = [o for o in doc.Objects if str(o.Id) not in before]
        for obj in created:
            try:
                doc.Objects.Delete(obj.Id, True)
            except Exception:
                pass


def positioning_dialog(initial):
    dlg = forms.Dialog[bool]()
    dlg.Title = 'AMCAD | Geometry Positioning'
    dlg.ClientSize = drawing.Size(350, 310)
    dlg.Resizable = False
    labels = ['X (mm)', 'Y (mm)', 'Z (mm)',
              'Rx (deg)', 'Ry (deg)', 'Rz (deg)']
    fields = []
    layout = forms.DynamicLayout()
    layout.Padding = drawing.Padding(15)
    layout.Spacing = drawing.Size(8, 8)
    for label, value in zip(labels, initial):
        field = forms.NumericStepper()
        field.MinValue = -1000000.0
        field.MaxValue = 1000000.0
        field.DecimalPlaces = 3
        field.Increment = 1.0
        field.Value = float(value)
        layout.AddRow(forms.Label(Text=label), field)
        fields.append(field)
    apply_btn = forms.Button(Text='Apply')
    cancel_btn = forms.Button(Text='Cancel')
    apply_btn.Click += lambda s, e: dlg.Close(True)
    cancel_btn.Click += lambda s, e: dlg.Close(False)
    layout.AddRow(None)
    layout.AddRow(None, apply_btn, cancel_btn)
    dlg.Content = layout
    accepted = dlg.ShowModal(Rhino.UI.RhinoEtoApp.MainWindow)
    if accepted:
        return [float(f.Value) for f in fields]
    return None


def transform_geometry(source, values):
    x, y, z, rx, ry, rz = values
    # Rotation about original CAD origin, in Rx -> Ry -> Rz order.
    transforms = [
        rg.Transform.Rotation(__import__('math').radians(rx), rg.Vector3d.XAxis, rg.Point3d.Origin),
        rg.Transform.Rotation(__import__('math').radians(ry), rg.Vector3d.YAxis, rg.Point3d.Origin),
        rg.Transform.Rotation(__import__('math').radians(rz), rg.Vector3d.ZAxis, rg.Point3d.Origin),
        rg.Transform.Translation(x, y, z),
    ]
    output = []
    for item in source:
        b = item.DuplicateBrep()
        for xf in transforms:
            if not b.Transform(xf):
                raise RuntimeError('Brep transform failed')
        output.append(b)
    return output


try:
    path = get_path(Geometry)
    pressed = bool(Positioning)
    rising_edge = pressed and not state['button_previous']
    state['button_previous'] = pressed
    if not path:
        log('Provide STEP path')
    elif not os.path.isfile(path):
        log('STEP file not found')
    elif os.path.splitext(path)[1].lower() not in ('.step', '.stp'):
        log('Expected .stp / .step')
    else:
        stamp = (os.path.getmtime(path), os.path.getsize(path))
        if state['path'] != path or state['stamp'] != stamp or not state['geometry']:
            source = load_step(path)
            state['geometry'] = source
            state['path'] = path
            state['stamp'] = stamp
            log('Loaded {} Brep(s)'.format(len(source)))
        if rising_edge:
            values = positioning_dialog(state['xyzr'])
            if values is not None:
                state['xyzr'] = values
                log('Placement updated')
        result = transform_geometry(state['geometry'], state['xyzr'])
        OriginalManifold = result[0] if len(result) == 1 else result
except Exception as exc:
    log('ERROR: {}'.format(exc))
    OriginalManifold = None
# ---------- end py3 ----------
panel = Panel("C:\Users\ookan\Documents\AMCAD-review\project.placements.json")
panel_2 = Panel("C:\Users\ookan\Documents\AMCAD-review\project.grasshopper_v3.json")
preview = CustomPreview(Geometry=py3, Material=ColourSwatch(SwatchColor=RGBA(0, 0, 255, 50)))
geometry_placement = Python3Script(
    Folder="C:\Users\ookan\Documents\AMCAD\integrations\grasshopper",
    ExportPath=panel_2,
    PlacementPath=panel,
    Edit=Button(),
    Save=Button(),
    Reload=Button())  # -> Cavities, Profiles, InterfaceAxes, InterfaceFrames, InstanceIDs, InterfaceMetadata, Connectivity, Transforms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; inputs Reload: list
# ---------- geometry_placement: Python ----------
"""AMCAD Phase 2 Cavity Placement with viewport selection highlight."""
import os
import sys
import json
import scriptcontext as sc
import Rhino
import Grasshopper as gh
from System import Object,Action
from Grasshopper import DataTree
from Grasshopper.Kernel.Data import GH_Path

Cavities=DataTree[Object]();Profiles=DataTree[Object]();InterfaceAxes=DataTree[Object]()
InterfaceFrames=DataTree[Object]();InterfaceMetadata=DataTree[Object]();Transforms=DataTree[Object]()
InstanceIDs=[];Connectivity='';PlacementState='';SelectedInstance='';CurrentPlacement='';Status=''
try:
    folder=str(Folder)
    if not os.path.isdir(folder):raise ValueError('Folder must be the integrations/grasshopper directory')
    if folder not in sys.path:sys.path.insert(0,folder)
    import amcad_runtime as runtime
    from placement_controller import PlacementController,CommandEdges
    import placement_editor as editor_module
    from rhino_importer import import_model
    data=runtime.load_export(str(ExportPath));path=str(PlacementPath) if PlacementPath else None
    component=ghenv.Component;document=component.OnPingDocument()
    key=('amcad-phase2',str(document.DocumentID),str(component.InstanceGuid))
    runtime.require(bool(path),'Set a separate PlacementPath before using the controller')
    binding=(data['project']['id'],os.path.normcase(os.path.realpath(path)))
    session=sc.sticky.get(key)
    if session is not None and session['binding']!=binding:
        runtime.require(not session['model'].dirty and not (session.get('window') and session['window'].pending()),'Save or reload/discard the previous session before changing project/placement paths')
        old=session.get('window')
        if old is not None:Rhino.RhinoApp.InvokeOnUiThread(Action(old.Close))
        gh.Instances.DocumentServer.DocumentRemoved-=session['removed_handler']
        sc.sticky.pop(key,None);session=None
    if session is None:
        session={'binding':binding,'model':PlacementController(data,path,str(ExportPath)),
                 'window':None,'commands':CommandEdges(),'preview_key':None,'models':None}
        sc.sticky[key]=session
        def document_removed(sender,removed,owned_session=session,owned_key=key,owned_id=str(document.DocumentID)):
            doc=getattr(removed,'Document',removed)
            if str(getattr(doc,'DocumentID',''))!=owned_id:return
            window=owned_session.get('window')
            if window is not None:Rhino.RhinoApp.InvokeOnUiThread(Action(window.Close))
            sc.sticky.pop(owned_key,None)
            gh.Instances.DocumentServer.DocumentRemoved-=owned_session['removed_handler']
        session['removed_handler']=document_removed
        gh.Instances.DocumentServer.DocumentRemoved+=document_removed
    model=session['model'];model.refresh_export(data,str(ExportPath))
    def schedule():
        doc=component.OnPingDocument()
        if doc is None:return
        def expire(solution_doc):
            owner=component.OnPingDocument()
            if owner is not None and owner.DocumentID==solution_doc.DocumentID:component.ExpireSolution(False)
        doc.ScheduleSolution(1,gh.Kernel.GH_Document.GH_ScheduleDelegate(expire))
    def closed(window):
        if session.get('window') is window:session['window']=None
    def lookup_selected(instance_id):
        for item in session.get('models') or []:
            if str(item.get('instance_id'))==str(instance_id):
                record=next((r for r in model.catalog() if str(r['id'])==str(instance_id)),None)
                return item['geometry'],(record['name'] if record else str(instance_id))
        return None
    def open_window():
        if session.get('window') is None:
            session['window']=editor_module.PlacementEditor(model,schedule,closed,lookup_selected)
            editor_module.show_editor(session['window'])
        else:session['window'].BringToFront()
    for name in session['commands'].consume({'Reload':Reload,'Save':Save,'Edit':Edit}):
        if name=='Reload':model.reload()
        elif name=='Save':model.save()
        else:Rhino.RhinoApp.InvokeOnUiThread(Action(open_window))
    window=session.get('window')
    if window is not None:Rhino.RhinoApp.InvokeOnUiThread(Action(window.sync))
    runtime.require(Rhino.RhinoDoc.ActiveDoc is not None and Rhino.RhinoDoc.ActiveDoc.ModelUnitSystem==Rhino.UnitSystem.Millimeters,'Set the Rhino document units to millimeters')
    preview_key=(model.version,Rhino.RhinoDoc.ActiveDoc.RuntimeSerialNumber)
    if session['preview_key']!=preview_key:
        session['models']=import_model(model.export_snapshot(),model.snapshot());session['preview_key']=preview_key
        if window is not None:Rhino.RhinoApp.InvokeOnUiThread(Action(window.update_highlight))
    for index,item in enumerate(session['models']):
        branch=GH_Path(index);InstanceIDs.append(item['instance_id'])
        Cavities.Add(item['geometry'],branch);Profiles.Add(item['profile'],branch)
        for axis in item['axes']:InterfaceAxes.Add(axis,branch)
        for frame in item['frames']:InterfaceFrames.Add(frame,branch)
        for interface in item['interfaces']:InterfaceMetadata.Add(json.dumps(interface),branch)
        for row in item['matrix']:
            for value in row:Transforms.Add(value,branch)
    PlacementState=json.dumps(model.snapshot(),indent=2);Connectivity=json.dumps(data['connectivity'],indent=2)
    record=next((r for r in model.parameters() if r['instance_id']==model.selected_id),None)
    if record:SelectedInstance=record['name'];CurrentPlacement=json.dumps(record,indent=2)
    Status='{} cavities · selected: {} · {}. Edit opens the six-field controller.'.format(len(InstanceIDs),SelectedInstance or 'none','UNSAVED placements' if model.dirty else 'saved placements')
except Exception as error:
    for tree in (Cavities,Profiles,InterfaceAxes,InterfaceFrames,InterfaceMetadata,Transforms):tree.Clear()
    InstanceIDs=[];Connectivity='';PlacementState='';SelectedInstance='';CurrentPlacement=''
    ghenv.Component.AddRuntimeMessage(gh.Kernel.GH_RuntimeMessageLevel.Error,str(error));Status='Placement controller failed: '+str(error)
# ---------- end geometry_placement ----------
panel_3 = Panel(geometry_placement.Status)
panel_4 = Panel()
panel_5 = Panel(geometry_placement.Connectivity)
amcad_routing_solver = Python3Script()  # -> graft(RoutedCurves), FailedRoutes, JunctionPoints, RouteMetadata, Report; inputs Cavities: tree of Brep, RoutingTerminals: list, WallThickness: Double, MinBendRatio: Double; disabled
# ---------- amcad_routing_solver: Python ----------
import json
import math
import Rhino
import Rhino.Geometry as rg

# AMCAD ROUTING SOLVER - bounded Brep clearance diagnostics
# Inputs: Cavities, RoutingTerminals, WallThickness, MinBendRatio, ExitAllowance
# Outputs: RoutedCurves, FailedRoutes, JunctionPoints, Report, RouteMetadata
RoutedCurves, FailedRoutes, JunctionPoints, Report, RouteMetadata = [], [], [], [], []
wall = max(0.0, float(WallThickness))
ratio = max(0.5, float(MinBendRatio))
exit_allowance = max(0.0, float(ExitAllowance))
tol = Rhino.RhinoDoc.ActiveDoc.ModelAbsoluteTolerance if Rhino.RhinoDoc.ActiveDoc else 0.01
SAMPLES = 24
HANDLE_FACTORS = (0.5, 1.0, 2.0, 3.0)
NOMINAL_THRESHOLD_MM = 10.0
TRANSITION_MM = 5.0
MAX_FACES_PER_CAVITY = 100

def unpack(x):
    return json.loads(x) if isinstance(x, str) else x

def flatten(x):
    if x is None:
        return []
    if hasattr(x, 'Branches'):
        return [v for branch in x.Branches for v in branch]
    return list(x) if isinstance(x, (tuple, list)) else [x]

def pt(a):
    return rg.Point3d(float(a[0]), float(a[1]), float(a[2]))

def vec(a):
    v = rg.Vector3d(float(a[0]), float(a[1]), float(a[2]))
    if not v.Unitize():
        raise ValueError('Zero direction vector')
    return v

def terminal(p):
    return pt(p['stub_endpoint']), vec(p['direction']), float(p['nominal_diameter_mm'])

def section_radius(port):
    s = port.get('section', {})
    kind = str(s.get('type', '')).upper()
    if kind == 'CIRCLE':
        r = float(s['diameter_mm']) / 2.0
    elif kind in ('RECTANGLE', 'SLOT'):
        r = math.hypot(float(s['width_mm']), float(s['height_mm'])) / 2.0
    else:
        raise ValueError('Unsupported section: {}'.format(kind))
    if r <= 0:
        raise ValueError('Invalid section radius')
    return r

def route_radius(f, length, r0, r1, rn):
    if length <= NOMINAL_THRESHOLD_MM:
        return max(r0, r1, rn)
    transition = min(TRANSITION_MM, length * 0.25)
    r = rn
    if f * length < transition:
        alpha = f * length / transition
        r = max(r, r0 * (1.0-alpha) + rn * alpha)
    if (1.0-f) * length < transition:
        alpha = (1.0-f) * length / transition
        r = max(r, r1 * (1.0-alpha) + rn * alpha)
    return r

def sample(curve, fraction, length):
    if fraction <= 0:
        t = curve.Domain.T0
    elif fraction >= 1:
        t = curve.Domain.T1
    else:
        ok, t = curve.LengthParameter(length * fraction)
        if not ok:
            raise ValueError('LengthParameter failed')
    return t, curve.PointAt(t)

def radius_ok(curve, r0, r1, rn):
    length = curve.GetLength()
    if length <= 0.01:
        return False
    for i in range(SAMPLES+1):
        f = float(i)/SAMPLES
        t, _ = sample(curve, f, length)
        k = curve.CurvatureAt(t).Length
        if k > 1e-9 and 1.0/k < ratio * 2.0 * route_radius(f, length, r0, r1, rn):
            return False
    return True

def bbox_distance(p, b):
    dx = max(b.Min.X-p.X, 0.0, p.X-b.Max.X)
    dy = max(b.Min.Y-p.Y, 0.0, p.Y-b.Max.Y)
    dz = max(b.Min.Z-p.Z, 0.0, p.Z-b.Max.Z)
    return math.sqrt(dx*dx + dy*dy + dz*dz)

def face_distance(p, brep, threshold):
    # Bounded face closest-point tests; no mesh/Boolean.
    best = float('inf')
    for face in brep.Faces:
        fb = face.GetBoundingBox(True)
        if bbox_distance(p, fb) > min(best, threshold):
            continue
        result = face.ClosestPoint(p)
        if not result or not result[0]:
            continue
        q = face.PointAt(result[1], result[2])
        d = p.DistanceTo(q)
        if d < best:
            best = d
    return best

def clearance_ok(curve, obstacles, r0, r1, rn):
    length = curve.GetLength()
    if length <= 0.01:
        return False
    for i in range(SAMPLES+1):
        f = float(i)/SAMPLES
        d0, d1 = f*length, (1.0-f)*length
        if d0 <= exit_allowance or d1 <= exit_allowance:
            continue
        _, p = sample(curve, f, length)
        clearance = route_radius(f, length, r0, r1, rn) + wall
        for brep, box in obstacles:
            if bbox_distance(p, box) > clearance:
                continue  # box is only a broad-phase rejection
            if brep.IsSolid and brep.IsPointInside(p, tol, False):
                return False
            if face_distance(p, brep, clearance) < clearance:
                return False
    return True

def bezier(a, b, c, d):
    return rg.Curve.CreateControlPointCurve([a, b, c, d], 3)

def solve_pair(a, b, obstacles):
    start, da, dia_a = terminal(a)
    end, db, dia_b = terminal(b)
    dia = max(dia_a, dia_b)
    dist = start.DistanceTo(end)
    counts = {'bend': 0, 'cavity': 0, 'accepted': 0}
    if dia <= 0 or dist <= 0.01:
        return None, counts
    r0, r1, rn = section_radius(a), section_radius(b), dia/2.0
    base = max(ratio*dia, dist*0.2)
    best, best_len = None, float('inf')
    for fa in HANDLE_FACTORS:
        for fb in HANDLE_FACTORS:
            curve = bezier(start, start+da*base*fa, end+db*base*fb, end)
            if not radius_ok(curve, r0, r1, rn):
                counts['bend'] += 1
                continue
            if not clearance_ok(curve, obstacles, r0, r1, rn):
                counts['cavity'] += 1
                continue
            counts['accepted'] += 1
            length = curve.GetLength()
            if length < best_len:
                best, best_len = curve, length
    return best, counts

def tangent_y_junction(ports):
    data = [terminal(p) for p in ports]
    points = [x[0] for x in data]
    junction = rg.Point3d(sum(p.X for p in points)/3.0,
                          sum(p.Y for p in points)/3.0,
                          sum(p.Z for p in points)/3.0)
    curves, used = [], []
    for port, (start, axis, dia) in zip(ports, data):
        delta = junction-start
        dist = delta.Length
        if dist <= 0.01:
            continue
        toward = rg.Vector3d(delta)
        toward.Unitize()
        handle = min(dist*0.30, max(ratio*dia, 10.0))
        curves.append(bezier(start, start+axis*handle,
                             junction-toward*handle, junction))
        used.append(port)
    return curves, used, junction

def section_data(port):
    return {k: port.get(k) for k in ('instance_id', 'interface_id', 'section',
                                    'section_u', 'section_v', 'stub_endpoint', 'direction')}

def append_route(curve, net_id, net_index, kind, start, end=None):
    length = curve.GetLength()
    nominal = max(float(start.get('nominal_diameter_mm', 0)),
                  float(end.get('nominal_diameter_mm', 0)) if end else 0)
    meta = {'route_index': len(RoutedCurves), 'net_id': str(net_id),
            'net_index': net_index, 'route_type': kind,
            'start_port': section_data(start),
            'end_port': section_data(end) if end else None,
            'nominal_diameter_mm': nominal, 'length_mm': length,
            'use_nominal_section': length > NOMINAL_THRESHOLD_MM,
            'nominal_threshold_mm': NOMINAL_THRESHOLD_MM,
            'transition_length_mm': min(TRANSITION_MM, length*0.25),
            'min_bend_ratio': ratio,
            'clearance_validation': 'SAMPLED_BREP' if kind == 'PAIR' else 'NOT_VALIDATED'}
    RoutedCurves.append(curve)
    RouteMetadata.append(json.dumps(meta))

try:
    cavities = [x for x in flatten(Cavities) if isinstance(x, rg.Brep)]
    for i, b in enumerate(cavities):
        if b.Faces.Count > MAX_FACES_PER_CAVITY:
            raise ValueError('Cavity {} exceeds {} faces; skipped for safety'.format(i, MAX_FACES_PER_CAVITY))
    obstacles = [(b, b.GetBoundingBox(True)) for b in cavities]
    terminals = [unpack(x) for x in flatten(RoutingTerminals)]
    nets = {}
    for x in terminals:
        nets.setdefault(str(x['net_id']), []).append(x)
    Report.append('{} cavities | {} terminals | {} nets'.format(
        len(cavities), len(terminals), len(nets)))
    for net_id, ports in nets.items():
        index = ports[0].get('net_index', '?')
        if len(ports) == 2:
            curve, counts = solve_pair(ports[0], ports[1], obstacles)
            Report.append('Net {}: 16 candidates | R/D reject={} | Brep reject={} | pass={}'.format(
                index, counts['bend'], counts['cavity'], counts['accepted']))
            if curve:
                append_route(curve, net_id, index, 'PAIR', ports[0], ports[1])
                Report.append('Net {}: routed {:.1f} mm'.format(index, curve.GetLength()))
            else:
                a, b = terminal(ports[0])[0], terminal(ports[1])[0]
                if a.DistanceTo(b) > 0.01:
                    FailedRoutes.append(rg.LineCurve(a, b))
                Report.append('Net {}: no valid route among 16 candidates'.format(index))
        elif len(ports) == 3:
            curves, used, junction = tangent_y_junction(ports)
            JunctionPoints.append(junction)
            for curve, port in zip(curves, used):
                append_route(curve, net_id, index, 'JUNCTION_BRANCH', port)
            Report.append('Net {}: Y preview {} branches (NOT validated)'.format(index, len(curves)))
        else:
            Report.append('Net {}: {} terminals unsupported'.format(index, len(ports)))
    Report.append('Routed curves: {} | Route metadata: {}'.format(len(RoutedCurves), len(RouteMetadata)))
    Report.append('PAIR: sampled local R/D and real Brep face clearance; no Boolean.')
    Report.append('NOT validated: Y, inter-route walls, endpoint penetration, final solids.')
except Exception as exc:
    Report.append('ERROR: {}'.format(exc))
# ---------- end amcad_routing_solver ----------
topology_editor = Python3Script(
    InterfaceMetadata=flatten(geometry_placement.InterfaceMetadata),
    Connectivity=geometry_placement.Connectivity,
    Edit=Button(),
    SidecarPath=panel_4,
    Reload=Button())  # -> ModifiedInterfaceMetadata, ModifiedConnectivity, Report; inputs InterfaceMetadata: list, Edit: Boolean, SidecarPath: String, Reload: Boolean
# ---------- topology_editor: Python ----------
# AMCAD Cavity Topology Editor - v2e named port + opt-in port/group highlight
# INPUTS: InterfaceMetadata [List, No Type Hint, Flatten]
#         Connectivity [Item, No Type Hint]
#         Edit [Item, bool], SidecarPath [Item, str], Reload [Item, bool]
# OUTPUTS: ModifiedInterfaceMetadata, ModifiedConnectivity, Report
# No Drawable. Optional single-port Rhino highlight; topology_core and GH wires unchanged.
import os
import sys
import json
import traceback
import Rhino
import scriptcontext as sc
import Grasshopper as gh
from System import Action

ModifiedInterfaceMetadata, ModifiedConnectivity, Report = [], '', []
Folder = r'C:\Users\ookan\Documents\AMCAD\integrations\grasshopper'
if Folder not in sys.path:
    sys.path.insert(0, Folder)
from topology_core import Topology, decode, flatten
import topology_ui
import importlib
importlib.reload(topology_ui)

def editor_key():
    return 'AMCAD_TOPOLOGY_EDITOR_V1_{}'.format(ghenv.Component.InstanceGuid)

def request_solution():
    component = ghenv.Component
    doc = component.OnPingDocument()
    if doc is None:
        return
    def expire(solution_doc):
        owner = component.OnPingDocument()
        if owner is not None and owner.DocumentID == solution_doc.DocumentID:
            component.ExpireSolution(False)
    doc.ScheduleSolution(10, gh.Kernel.GH_Document.GH_ScheduleDelegate(expire))

try:
    path = str(SidecarPath or '').strip()
    if not path:
        raise ValueError('SidecarPath is required')
    metadata = [decode(x) for x in flatten(InterfaceMetadata)]
    connectivity = decode(Connectivity)
    if not metadata:
        raise ValueError('No InterfaceMetadata')
    stamp = json.dumps([metadata, connectivity], sort_keys=True)
    state = sc.sticky.get(editor_key())
    if not isinstance(state, dict) or state.get('stamp') != stamp or state.get('path') != path:
        previous = state if isinstance(state, dict) else {}
        if previous.get('window') is not None:
            Rhino.RhinoApp.InvokeOnUiThread(Action(previous['window'].Close))
        sidecar = Topology.load(path) if os.path.isfile(path) else None
        state = {'model': Topology(metadata, connectivity, sidecar),
                 'metadata': metadata, 'connectivity': connectivity,
                 'stamp': stamp, 'path': path, 'window': None,
                 'pressed': previous.get('pressed', False),
                 'reload_pressed': False, 'ui_error': None}
        sc.sticky[editor_key()] = state
    reload_pressed = bool(Reload)
    if reload_pressed and not state.get('reload_pressed', False):
        sidecar = Topology.load(path) if os.path.isfile(path) else None
        state['model'] = Topology(metadata, connectivity, sidecar)
    state['reload_pressed'] = reload_pressed
    pressed = bool(Edit)
    if pressed and not state.get('pressed', False):
        def show():
            try:
                win = state.get('window')
                if win is None or not win.Visible:
                    win = topology_ui.TopologyEditor(state, request_solution)
                    state['window'] = win
                    win.Show()
                else:
                    win.BringToFront()
                state['ui_error'] = None
            except Exception:
                state['ui_error'] = traceback.format_exc()
                Rhino.RhinoApp.WriteLine('AMCAD topology UI v2e ERROR: ' + state['ui_error'])
                request_solution()
        Rhino.RhinoApp.InvokeOnUiThread(Action(show))
    state['pressed'] = pressed
    ModifiedInterfaceMetadata, ModifiedConnectivity = state['model'].outputs()
    Report = ['Topology Editor v2e: {} ports / {} routing groups'.format(
              len(ModifiedInterfaceMetadata), len(state['model'].doc['groups'])),
              'Standard Eto lists; no canvas. Highlight opt-in only.',
              'Edits are draft-only until Save topology + apply to GH.']
    if state.get('ui_error'):
        Report.insert(0, 'UI ERROR: ' + state['ui_error'])
except Exception:
    ModifiedInterfaceMetadata, ModifiedConnectivity = [], ''
    Report = ['ERROR: ' + traceback.format_exc()]
# ---------- end topology_editor ----------
panel_6 = Panel(topology_editor.Report)
port_preparation = Python3Script(
    Cavities=flatten(geometry_placement.Cavities),
    InterfaceMetadata=flatten(topology_editor.ModifiedInterfaceMetadata),
    Profiles=flatten(geometry_placement.Profiles),
    StubLength=Slider(1, range=0..10))  # -> PreparedCavities, PreparedPorts, Report; inputs Cavities: list of Brep, InterfaceMetadata: list, Profiles: list of Curve
# ---------- port_preparation: Python ----------
import json
import math
import Rhino
import Rhino.Geometry as rg

# AMCAD Port Preparation v17 | ADAPTIVE EXIT + OPTIONAL PHYSICAL STUB
# Inputs: Cavities (List Brep, Flatten), Profiles (List Curve, Flatten), InterfaceMetadata (List, Flatten), StubLength (Item float)
# Outputs: PreparedCavities (List Brep), PreparedPorts (List JSON), Report (List String)
# No Boolean solids, no arbitrary penetration/stub lengths.
PreparedCavities, PreparedPorts, Report = [], [], []
doc = Rhino.RhinoDoc.ActiveDoc
tol = doc.ModelAbsoluteTolerance if doc else 0.01
MAX_PORTS = 120
# Extra straight wet-wall length beyond v16 adaptive exit, in mm.
# Never change the v16 cut reach or its exit calculation.
stub_extra = float(StubLength) if StubLength is not None else 0.0
if not math.isfinite(stub_extra) or stub_extra < 0.0:
    raise ValueError("StubLength must be finite and nonnegative (mm)")
MAX_PIECES = 80
EPS = max(tol * 2.0, 0.001)

def unpack(value):
    if isinstance(value, str):
        return json.loads(value)
    return value

def flatten(value):
    if value is None:
        return []
    if hasattr(value, "Branches"):
        return [
            item
            for branch in value.Branches
            for item in branch
        ]
    if isinstance(value, (list, tuple)):
        return list(value)
    return [value]

def pt(values):
    return rg.Point3d(
        float(values[0]),
        float(values[1]),
        float(values[2])
    )

def xyz(point):
    return [point.X, point.Y, point.Z]

def direction(values):
    vector = rg.Vector3d(
        float(values[0]),
        float(values[1]),
        float(values[2])
    )
    if not vector.Unitize():
        raise ValueError("Invalid direction vector")
    return vector

def terminal_key(terminal):
    return (
        str(terminal["instance_id"]),
        str(terminal["interface_id"])
    )

def line(a, b):
    if a.DistanceTo(b) <= tol:
        return None
    return rg.LineCurve(a, b)

# ============================================================
# AMCAD PORT SECTION
# ============================================================

def section_curve(item, origin):
    section = item.get("section", {})
    shape = str(section.get("type", "")).upper()
    u = direction(item["section_u"])
    v = direction(item["section_v"])
    plane = rg.Plane(origin, u, v)
    if not plane.IsValid:
        raise ValueError("Invalid port section plane")
    # --------------------------------------------------------
    # CIRCLE
    # --------------------------------------------------------
    if shape == "CIRCLE":
        diameter = float(section["diameter_mm"])
        if diameter <= 0:
            raise ValueError("Invalid CIRCLE diameter")
        return rg.Circle(
            plane,
            diameter / 2.0
        ).ToNurbsCurve()
    # --------------------------------------------------------
    # RECTANGLE
    # --------------------------------------------------------
    if shape == "RECTANGLE":
        width = float(section["width_mm"])
        height = float(section["height_mm"])
        if width <= 0 or height <= 0:
            raise ValueError("Invalid RECTANGLE dimensions")
        rectangle = rg.Rectangle3d(
            plane,
            rg.Interval(-width / 2.0, width / 2.0),
            rg.Interval(-height / 2.0, height / 2.0)
        )
        return rectangle.ToNurbsCurve()
    # --------------------------------------------------------
    # SLOT
    # Standard capsule:
    # width_mm / height_mm are overall outside dimensions.
    # --------------------------------------------------------
    if shape == "SLOT":
        width = float(section["width_mm"])
        height = float(section["height_mm"])
        if width <= 0 or height <= 0:
            raise ValueError("Invalid SLOT dimensions")
        radius = min(width, height) / 2.0
        half_straight = (
            max(width, height) - min(width, height)
        ) / 2.0
        if half_straight <= tol:
            return rg.Circle(
                plane,
                radius
            ).ToNurbsCurve()
        def p(x, y):
            return plane.PointAt(x, y)
        if width >= height:
            # Horizontal slot
            a = half_straight
            r = radius
            segments = [
                rg.LineCurve(
                    p(-a, -r),
                    p(a, -r)
                ),
                rg.ArcCurve(
                    rg.Arc(
                        p(a, -r),
                        p(a + r, 0),
                        p(a, r)
                    )
                ),
                rg.LineCurve(
                    p(a, r),
                    p(-a, r)
                ),
                rg.ArcCurve(
                    rg.Arc(
                        p(-a, r),
                        p(-a - r, 0),
                        p(-a, -r)
                    )
                )
            ]
        else:
            # Vertical slot
            a = half_straight
            r = radius
            segments = [
                rg.LineCurve(
                    p(r, -a),
                    p(r, a)
                ),
                rg.ArcCurve(
                    rg.Arc(
                        p(r, a),
                        p(0, a + r),
                        p(-r, a)
                    )
                ),
                rg.LineCurve(
                    p(-r, a),
                    p(-r, -a)
                ),
                rg.ArcCurve(
                    rg.Arc(
                        p(-r, -a),
                        p(0, -a - r),
                        p(r, -a)
                    )
                )
            ]
        joined = rg.Curve.JoinCurves(segments, tol)
        if len(joined) != 1 or not joined[0].IsClosed:
            raise ValueError(
                "SLOT profile could not be closed"
            )
        return joined[0]
    raise ValueError(
        "Unsupported AMCAD section type: {}".format(shape)
    )

# ============================================================
# EXTRUDE ORIGINAL AMCAD SECTION
# ============================================================


def nearest_cavity(point, cavities):
    # RhinoCommon Brep.ClosestPoint has an overload with OUT parameters;
    # calling it with only a Point3d can throw in Rhino 8 Python 3.
    # Evaluate each surface face directly using (success, u, v).
    best = None
    best_dist = float("inf")
    errors = []
    for i, brep in enumerate(cavities):
        for face_index in range(brep.Faces.Count):
            face = brep.Faces[face_index]
            try:
                result = face.ClosestPoint(point)
                if not result or not result[0]:
                    continue
                closest = face.PointAt(result[1], result[2])
                gap = point.DistanceTo(closest)
                if gap < best_dist:
                    best, best_dist = i, gap
            except Exception as exc:
                if len(errors) < 3:
                    errors.append("cavity {} face {}: {}".format(
                        i, face_index, exc))
    if best is None:
        raise ValueError("No usable cavity surface; " + "; ".join(errors))
    if best_dist > max(0.1, tol * 10.0):
        raise ValueError(
            "Port center not on cavity surface (nearest gap {:.3f} mm, cavity {})".format(
                best_dist, best))
    return best, best_dist


# Port openings are constrained to the face actually carrying the
# AMCAD port center. Other walls are never split by a long cutter.
# The incoming Breps are wet surfaces, not solid cutters.

MAX_SPLIT_PARTS = 80
BOUNDARY_SAMPLES = 48
NUM_STEPS = 16

def face_for_port(cavity, center):
    best = None
    gap = float('inf')
    for fi in range(cavity.Faces.Count):
        face = cavity.Faces[fi]
        ok, u, v = face.ClosestPoint(center)
        if ok:
            d = center.DistanceTo(face.PointAt(u,v))
            if d < gap:
                gap, best = d, fi
    if best is None or gap > max(tol*10, 0.1):
        raise ValueError('Port center not on cavity face')
    return best

def boundary_points(curve, n=BOUNDARY_SAMPLES):
    length=curve.GetLength()
    if length < tol: raise ValueError('Invalid port perimeter')
    points=[]
    for k in range(n):
        ok,t=curve.LengthParameter(length*k/float(n))
        if not ok: raise ValueError('Cannot sample port perimeter')
        points.append(curve.PointAt(t))
    return points

def section_inside(item, point, center, axis, margin=0.0):
    delta=point-center
    delta-=axis*(delta*axis)
    u=direction(item['section_u']); v=direction(item['section_v'])
    x=delta*u; y=delta*v
    s=item['section']; typ=str(s['type']).upper()
    if typ=='CIRCLE':
        r=float(s['diameter_mm'])/2.0 + margin
        return x*x+y*y < r*r
    if typ=='RECTANGLE':
        return abs(x)<float(s['width_mm'])/2.0+margin and abs(y)<float(s['height_mm'])/2.0+margin
    if typ=='SLOT':
        w=float(s['width_mm']); h=float(s['height_mm']); r=min(w,h)/2.0+margin
        if w>=h:
            dx=max(abs(x)-(w-h)/2.0,0.0); return dx*dx+y*y < r*r
        dy=max(abs(y)-(h-w)/2.0,0.0); return x*x+dy*dy < r*r
    raise ValueError('Unknown port section')

def surface_hit_distances(brep, point, axis, reach):
    ray=rg.LineCurve(point-axis*reach, point+axis*reach)
    hit=rg.Intersect.Intersection.CurveBrep(ray,brep,tol)
    if not hit: return []
    # CurveBrep returns (bool, overlapCurves, intersectionPoints).
    values=[]
    for p in (hit[2] or []):
        d=(p-point)*axis
        if -reach <= d <= reach: values.append(d)
    return sorted(values)

def outward_clearance(profile, face_brep, center, axis, reach):
    # First exit envelope for the local surface only, never other faces.
    # For each perimeter point, choose the intersection nearest to its
    # original section plane, not the farthest across the cavity.
    ds=[]
    for p in boundary_points(profile):
        hits=surface_hit_distances(face_brep,p,axis,reach)
        if hits:
            ds.append(min(hits,key=lambda d:abs(d)))
    if not ds:
        raise ValueError('Port wall does not intersect selected face')
    return max(0.0,max(ds))

def is_full_end_cap(face_brep, item, center, axis):
    # Full end-face opening: no artificial cylinder is necessary.
    # Restrict to planar faces perpendicular to the port direction.
    if face_brep.Faces.Count != 1: return False
    face=face_brep.Faces[0]
    ok,plane=face.TryGetPlane()
    if not ok: return False
    normal=plane.Normal
    if abs(normal*axis)<0.995: return False
    points=[]
    for edge in face_brep.Edges:
        length=edge.GetLength()
        if length<=tol: continue
        for j in range(32):
            good,t=edge.LengthParameter(length*j/32.0)
            if good: points.append(edge.PointAt(t))
    if not points: return False
    # All cap boundary points must be inside the port perimeter.
    return all(section_inside(item,p,center,axis,max(tol*5,0.03)) for p in points)

def patch_samples(part):
    # Collect points on ACTUAL trimmed pieces, not only UV interior grids.
    samples=[]
    for face in part.Faces:
        du=face.Domain(0); dv=face.Domain(1)
        for iu in range(1,16):
            for iv in range(1,16):
                u=du.T0+(du.T1-du.T0)*iu/16.0
                v=dv.T0+(dv.T1-dv.T0)*iv/16.0
                if face.IsPointOnFace(u,v) == rg.PointFaceRelation.Interior:
                    samples.append(face.PointAt(u,v))
    # Tiny/seam patches may have no UV grid samples. Sample edges instead.
    if not samples:
        for edge in part.Edges:
            for j in range(1,8):
                samples.append(edge.PointAtNormalizedLength(j/8.0))
    return samples

def patch_area(part):
    mass=rg.AreaMassProperties.Compute(part)
    if mass is not None and math.isfinite(mass.Area) and mass.Area>tol*tol:
        return mass.Area
    # Failed area evaluation is NOT a reason to remove the geometry.
    return None

def local_cut_reach(host, center, axis, global_reach):
    # Bound the cutter by the nearest SECOND wall along the port axis.
    # The origin is on the FIRST wall (d=0). The opposite side of the
    # same revolved section must not be reached by the cutting surface.
    hits = surface_hit_distances(host, center, axis, global_reach)
    others = [abs(d) for d in hits if abs(d) > max(tol*20.0, 0.05)]
    if not others:
        # No remote intersection on the centerline: use a short local
        # cutter rather than the full cavity-spanning extrusion.
        return min(global_reach, max(0.5, tol*50.0))
    clearance = min(others)
    if clearance <= max(tol*20.0, 0.05):
        raise ValueError('Cannot isolate first wall from another wall')
    return min(global_reach, clearance*0.45)

def open_face(face_brep, profile, item, center, axis, reach, exit_dist):
    # Only the selected HOST face is split. Never split the full cavity.
    # IMPORTANT: a long cutter intersects the opposite side of a
    # 360-degree cylinder. Only cut a neighborhood of position_mm.
    # A positive outward intersection envelope means that the port
    # perimeter must travel beyond its origin plane to reach the host.
    # Preserve the full cutter used in v14 for this geometry (e.g. 45 deg).
    # For near-zero exits use v15's local cutter to avoid the far wall.
    angled_or_oblique = exit_dist > max(0.1, tol*10.0)
    cut_reach = reach if angled_or_oblique else local_cut_reach(face_brep, center, axis, reach)
    cut_profile=profile.DuplicateCurve()
    cut_profile.Transform(rg.Transform.Translation(-axis*cut_reach))
    cutter=rg.Surface.CreateExtrusion(cut_profile,axis*(2*cut_reach))
    if cutter is None: raise ValueError('Cutter construction failed')
    pieces=face_brep.Split(cutter.ToBrep(),tol)
    if not pieces or len(pieces)<2: raise ValueError('Host face did not split')
    if len(pieces)>MAX_SPLIT_PARTS: raise ValueError('Too many split patches')
    kept=[]; removed=0
    for i,part in enumerate(pieces):
        if not part.IsValid: raise ValueError('Invalid split patch {}'.format(i))
        samples=patch_samples(part)
        if not samples: raise ValueError('Patch {} has no samples'.format(i))
        # Keep any patch with evidence outside the port footprint.
        # Delete only patches entirely contained within its footprint.
        inside=sum(1 for q in samples if section_inside(item,q,center,axis,-tol*2))
        outside=sum(1 for q in samples if not section_inside(item,q,center,axis,tol*2))
        if outside:
            kept.append(part)
        elif inside:
            removed+=1
        else:
            kept.append(part)  # boundary-only patch is preserved, never deleted
    if not kept or not removed:
        raise ValueError('No isolated opening: removed={} kept={}'.format(removed,len(kept)))
    return kept,removed

def port_lateral(profile, center, axis, host, exit_dist, reach, extra_length=0.0):
    # This is an OPEN lateral surface, not a capped solid.
    # Its start is deliberately on the inward side so it can intersect
    # the true host surface; the inward portion is removed by host split.
    out_dist = max(0.0,exit_dist) + max(0.05, tol*5)
    total_out_dist = out_dist + extra_length
    start = profile.DuplicateCurve()
    start.Transform(rg.Transform.Translation(-axis*reach))
    surface = rg.Surface.CreateExtrusion(start, axis*(reach+total_out_dist))
    if surface is None:
        raise ValueError('Port lateral extrusion failed')
    wall = surface.ToBrep()
    split = wall.Split(host, tol)
    if not split:
        raise ValueError('Port lateral did not split at hosting face')
    # Keep only one outward piece; fail rather than retain arbitrary pieces.
    candidates = []
    for part in split:
        if not part.IsValid: continue
        verts = [v.Location for v in part.Vertices]
        if not verts: continue
        lo = min((v-center)*axis for v in verts)
        hi = max((v-center)*axis for v in verts)
        if hi >= total_out_dist - max(tol*4, 0.03) and lo <= exit_dist + max(tol*4,0.03):
            candidates.append(part)
    if len(candidates) != 1:
        raise ValueError('Ambiguous port lateral: {} exterior pieces'.format(len(candidates)))
    return candidates[0], total_out_dist

# ============================================================
# REVOLVE PROFILE SECTION RECONSTRUCTION
# Each physical segment becomes a separate Brep. We do not
# guess a revolve axis: it must exist on the source surface.
# ============================================================

def segments_of(curve):
    if isinstance(curve, rg.PolyCurve):
        return [s.DuplicateCurve() for s in curve.DuplicateSegments()]
    poly = rg.Polyline()
    try:
        ok, poly = curve.TryGetPolyline()
        if ok and poly.Count > 2:
            return [rg.LineCurve(poly[i], poly[i+1]) for i in range(poly.Count-1)
                    if poly[i].DistanceTo(poly[i+1]) > tol]
    except Exception:
        pass
    # A planar curve is not necessarily a polycurve. Do not
    # invent section boundaries if its geometry is unsegmented.
    return [curve.DuplicateCurve()]

def revolve_axis(cavity):
    for face in cavity.Faces:
        surf=face.UnderlyingSurface()
        if isinstance(surf, rg.RevSurface):
            return surf.Axis
    raise ValueError('Underlying surface is not RevSurface; cannot reconstruct sections safely')

def section_breps(cavity, profile):
    axis=revolve_axis(cavity)
    result=[]
    for si,segment in enumerate(segments_of(profile)):
        if segment.GetLength() <= tol: continue
        rev=rg.RevSurface.Create(segment,axis)
        if rev is None: raise ValueError('Section {} revolve failed'.format(si))
        brep=rev.ToBrep()
        if brep is None or not brep.IsValid:
            raise ValueError('Section {} Brep invalid'.format(si))
        result.append((si,brep))
    if not result: raise ValueError('No valid profile sections')
    # Guard against mismatched original profiles / axes.
    bb0=cavity.GetBoundingBox(True)
    bb1=rg.BoundingBox.Unset
    for _,b in result:
        if not bb1.IsValid: bb1=b.GetBoundingBox(True)
        else: bb1.Union(b.GetBoundingBox(True))
    if not bb1.IsValid or bb0.Center.DistanceTo(bb1.Center)>max(0.1,tol*10):
        raise ValueError('Profile revolve does not match cavity placement')
    return result

def host_section(parts,center):
    hits=[]
    for i,(si,b) in enumerate(parts):
        for face in b.Faces:
            ok,u,v=face.ClosestPoint(center)
            if not ok: continue
            if center.DistanceTo(face.PointAt(u,v))<=max(tol*5,0.02):
                hits.append((i,si))
                break
    # At a profile corner two segments may contain the point.
    # In that case choose the one most normal to port direction
    # in the caller; never arbitrarily delete both.
    return hits

try:
    cavities=[b.DuplicateBrep() for b in flatten(Cavities) if isinstance(b,rg.Brep)]
    profiles=[c for c in flatten(Profiles) if isinstance(c,rg.Curve)]
    interfaces=[unpack(x) for x in flatten(InterfaceMetadata)]
    if not cavities: raise ValueError('No cavity Breps')
    if len(profiles)!=len(cavities):
        raise ValueError('Expected one Profile per Cavity: {} profiles, {} cavities'.format(len(profiles),len(cavities)))
    if len(interfaces)>MAX_PORTS: raise ValueError('Too many interfaces')
    sections=[]
    for ci,(cavity,profile) in enumerate(zip(cavities,profiles)):
        try:
            parts=section_breps(cavity,profile)
            sections.append(parts)
            Report.append('Cavity {} | {} reconstructed profile section(s)'.format(ci,len(parts)))
        except Exception as exc:
            sections.append([(0,cavity)])
            Report.append('Cavity {} SECTION FALLBACK (unchanged until verified): {}'.format(ci,exc))
    assigned={i:[] for i in range(len(cavities))}
    for idx,item in enumerate(interfaces):
        try:
            center=pt(item['position_mm'])
            matches=[]
            for ci,cavity in enumerate(cavities):
                for face in cavity.Faces:
                    ok,u,v=face.ClosestPoint(center)
                    if ok and center.DistanceTo(face.PointAt(u,v))<=max(tol*5,0.02):
                        if face.IsPointOnFace(u,v)!=rg.PointFaceRelation.Exterior:
                            matches.append(ci)
                            break
            if len(matches)!=1: raise ValueError('Origin belongs to {} cavities: {}'.format(len(matches),matches))
            assigned[matches[0]].append((idx,item))
        except Exception as exc:
            Report.append('Port {} ASSIGN FAILED: {}'.format(idx,exc))
    all_surfaces=[]
    for ci,cavity in enumerate(cavities):
        parts=sections[ci]
        reconstructed=(len(parts)>1 or parts[0][1] is not cavity)
        for idx,item in assigned[ci]:
            try:
                if not reconstructed:
                    raise ValueError('No verified section reconstruction; original cavity preserved')
                center=pt(item['position_mm']); axis=direction(item['direction'])
                profile=section_curve(item,center)
                hits=host_section(parts,center)
                if len(hits)!=1:
                    raise ValueError('Port origin on {} profile sections: {}'.format(len(hits),hits))
                k,si=hits[0]; host=parts[k][1]
                reach=max(5.0,host.GetBoundingBox(True).Diagonal.Length*2)
                exit_dist=outward_clearance(profile,host,center,axis,reach)
                full_cap=is_full_end_cap(host,item,center,axis)
                if full_cap:
                    kept=[]; removed=1; lateral=None; outer=stub_extra
                    if stub_extra > 0.0:
                        # Full cap was removed; extend its exact original section
                        # as an uncapped lateral wet surface, never a solid.
                        extension=rg.Surface.CreateExtrusion(profile,axis*stub_extra)
                        if extension is None:
                            raise ValueError('FULL_CAP stub extrusion failed')
                        lateral=extension.ToBrep()
                        if lateral is None or not lateral.IsValid:
                            raise ValueError('FULL_CAP stub Brep invalid')
                else:
                    kept,removed=open_face(host,profile,item,center,axis,reach,exit_dist)
                    lateral,outer=port_lateral(profile,center,axis,host,exit_dist,reach,stub_extra)
                # Commit only after both trim and lateral succeed.
                parts.pop(k)
                for offset,b in enumerate(kept): parts.insert(k+offset,(si,b))
                if lateral is not None: all_surfaces.append(lateral)
                end=center+axis*outer
                PreparedPorts.append(json.dumps({
                    'instance_id':str(item['instance_id']),
                    'interface_id':str(item['id']),
                    'label':item.get('label',''),
                    'start_point':xyz(center),'stub_endpoint':xyz(end),
                    'safe_exit_point':xyz(center+axis*(outer-stub_extra)),
                    'prepared_stub_endpoint':xyz(center+axis*(outer-stub_extra)),
                    'extra_stub_length_mm':stub_extra,
                    'direction':[axis.X,axis.Y,axis.Z],
                    'section':item['section'],
                    'section_u':item['section_u'],'section_v':item['section_v'],
                    'cavity_index':ci,'profile_section_index':si,
                    'nominal_diameter_mm':float(item['section'].get('diameter_mm',max(item['section'].get('width_mm',0),item['section'].get('height_mm',0))))
                }))
                Report.append('Port {} OK | cavity {} section {} | {} | exit {:.3f} mm | removed {} patch(es)'.format(idx,ci,si,'FULL_CAP' if full_cap else 'SURFACE_OPENING',outer,removed))
            except Exception as exc:
                Report.append('Port {} FAILED: {}'.format(idx,exc))
        all_surfaces.extend(b for _,b in parts)
    PreparedCavities=all_surfaces
    Report.append('Additional physical stub: {:.3f} mm'.format(stub_extra))
    Report.append('Prepared {}/{} ports | {} wet surface Breps'.format(len(PreparedPorts),len(interfaces),len(PreparedCavities)))
    Report.append('ADAPTIVE MODE: local first-wall cutter for near-zero exits; full cutter for positive exit envelope; no solid Booleans')
except Exception as exc:
    Report.append('ERROR: {}'.format(exc))
# ---------- end port_preparation ----------
panel_7 = Panel(port_preparation.Report)
connectivity = Python3Script(PreparedPorts=flatten(port_preparation.PreparedPorts), Connectivity=topology_editor.ModifiedConnectivity)  # -> RoutingTerminals, NetTopology, Report; inputs PreparedPorts: list
# ---------- connectivity: Python ----------
import json
import math

# AMCAD CONNECTIVITY v3 - POST PORT PREPARATION v17
# Inputs: PreparedPorts (List, No Type Hint, Flatten)
#         Connectivity (Item, No Type Hint, None)
# Outputs: RoutingTerminals (List JSON), NetTopology (List JSON), Report (List String)
# Compatible with AMCAD Port Preparation v17 and Routing Solver v12.
# StubLength is owned by Port Preparation v17; do not extend terminals here.
# PreparedPorts.stub_endpoint is already the final routing origin.
# No geometry generation, no RhinoCommon operations.

RoutingTerminals = []
NetTopology = []
Report = []
MAX_PORTS = 120
MAX_NETS = 120
MAX_TERMINALS_PER_NET = 120


def unpack(value):
    if isinstance(value, str):
        return json.loads(value)
    return value


def flatten(value):
    if value is None:
        return []
    if hasattr(value, 'Branches'):
        return [item for branch in value.Branches for item in branch]
    if isinstance(value, (tuple, list)):
        return list(value)
    return [value]


def vec3(value, name):
    if not isinstance(value, (list, tuple)) or len(value) != 3:
        raise ValueError('{} must contain 3 coordinates'.format(name))
    result = [float(v) for v in value]
    if not all(math.isfinite(v) for v in result):
        raise ValueError('{} contains non-finite coordinates'.format(name))
    return result


def validate_port(p):
    if not isinstance(p, dict):
        raise ValueError('Port must be a JSON object')
    for field in ('instance_id', 'interface_id', 'start_point',
                  'stub_endpoint', 'direction', 'nominal_diameter_mm',
                  'section', 'section_u', 'section_v'):
        if field not in p:
            raise ValueError('Missing field {}'.format(field))
    key = (str(p['instance_id']), str(p['interface_id']))
    if not all(key):
        raise ValueError('Empty instance/interface ID')
    vec3(p['start_point'], 'start_point')
    vec3(p['stub_endpoint'], 'stub_endpoint')
    d = vec3(p['direction'], 'direction')
    norm = math.sqrt(sum(x*x for x in d))
    if norm < 1e-9:
        raise ValueError('Zero direction')
    if not isinstance(p['section'], dict):
        raise ValueError('section must be an object')
    shape = str(p['section'].get('type', '')).upper()
    if shape == 'CIRCLE':
        dimensions = ('diameter_mm',)
    elif shape in ('RECTANGLE', 'SLOT'):
        dimensions = ('width_mm', 'height_mm')
    else:
        raise ValueError('Unsupported section type {}'.format(shape))
    for dim in dimensions:
        size = float(p['section'][dim])
        if not math.isfinite(size) or size <= 0:
            raise ValueError('Invalid section dimension {}'.format(dim))
    for field in ('section_u', 'section_v'):
        if math.sqrt(sum(x*x for x in vec3(p[field], field))) < 1e-9:
            raise ValueError('Zero {}'.format(field))
    diameter = float(p['nominal_diameter_mm'])
    if not math.isfinite(diameter) or diameter <= 0:
        raise ValueError('Invalid nominal diameter')
    return key


def read_graph(value):
    raw = unpack(value)
    if isinstance(raw, (list, tuple)):
        if len(raw) != 1:
            raise ValueError('Connectivity expects exactly one graph object')
        raw = unpack(raw[0])
    if not isinstance(raw, dict) or not isinstance(raw.get('nets'), list):
        raise ValueError('Connectivity must be an object containing nets list')
    return raw


try:
    raw_ports = flatten(PreparedPorts)
    if not raw_ports:
        raise ValueError('PreparedPorts is empty')
    if len(raw_ports) > MAX_PORTS:
        raise ValueError('Too many PreparedPorts')
    graph = read_graph(Connectivity)
    nets = graph['nets']
    if len(nets) > MAX_NETS:
        raise ValueError('Too many nets')

    ports = {}
    duplicate_keys = set()
    invalid_ports = 0
    for i, raw in enumerate(raw_ports):
        try:
            p = unpack(raw)
            key = validate_port(p)
            if key in ports:
                duplicate_keys.add(key)
                Report.append('PORT DUPLICATE {}: {}'.format(i, key))
            else:
                ports[key] = p
        except Exception as exc:
            invalid_ports += 1
            Report.append('PORT INVALID {}: {}'.format(i, exc))
    for key in duplicate_keys:
        ports.pop(key, None)

    # Preflight shared references so both affected nets are rejected.
    owners = {}
    for ni, net in enumerate(nets):
        if not isinstance(net, dict) or not isinstance(net.get('terminals'), list):
            continue
        for t in net['terminals'][:MAX_TERMINALS_PER_NET]:
            if isinstance(t, dict) and 'instance_id' in t and 'interface_id' in t:
                key = (str(t['instance_id']), str(t['interface_id']))
                owners.setdefault(key, set()).add(ni)
    used = {}
    seen_net_ids = set()
    valid_nets = 0
    invalid_nets = 0
    for index, net in enumerate(nets):
        net_id = str(net.get('id', index + 1)) if isinstance(net, dict) else str(index + 1)
        problems = []
        accepted = []
        keys = []
        if net_id in seen_net_ids:
            problems.append('duplicate net ID')
        seen_net_ids.add(net_id)
        terminals = net.get('terminals') if isinstance(net, dict) else None
        if not isinstance(terminals, list):
            problems.append('terminals must be a list')
            terminals = []
        if len(terminals) > MAX_TERMINALS_PER_NET:
            problems.append('too many terminals')
            terminals = []
        local_seen = set()
        for t in terminals:
            if not isinstance(t, dict) or 'instance_id' not in t or 'interface_id' not in t:
                problems.append('malformed terminal reference')
                continue
            key = (str(t['instance_id']), str(t['interface_id']))
            keys.append(list(key))
            if key in local_seen:
                problems.append('repeated terminal {}'.format(key))
            local_seen.add(key)
            if key in duplicate_keys:
                problems.append('ambiguous PreparedPort {}'.format(key))
            elif key not in ports:
                problems.append('missing PreparedPort {}'.format(key))
            else:
                accepted.append((key, ports[key]))
            if len(owners.get(key, set())) > 1:
                problems.append('terminal {} referenced by multiple nets'.format(key))
            used[key] = net_id
        if len(terminals) < 2:
            problems.append('net needs at least two terminals')
        topology = {
            'net_id': net_id,
            'net_index': index + 1,
            'terminal_keys': keys,
            'terminal_count': len(terminals),
            'valid': not problems,
            'errors': problems
        }
        NetTopology.append(json.dumps(topology))
        if problems:
            invalid_nets += 1
            Report.append('Net {} INVALID: {}'.format(net_id, '; '.join(problems)))
            continue
        valid_nets += 1
        for key, port in accepted:
            data = dict(port)
            data['instance_id'] = key[0]
            data['interface_id'] = key[1]
            data['net_id'] = net_id
            data['net_index'] = index + 1
            RoutingTerminals.append(json.dumps(data))
        Report.append('Net {} OK | {} terminals'.format(net_id, len(accepted)))

    unused = [key for key in ports if key not in used]
    if unused:
        Report.append('UNCONNECTED prepared ports ({}): {}'.format(len(unused), unused))
    Report.append('SUMMARY | prepared={} | invalid_ports={} | duplicate_keys={} | nets_ok={} | nets_invalid={} | routing_terminals={}'.format(
        len(raw_ports), invalid_ports, len(duplicate_keys), valid_nets, invalid_nets, len(RoutingTerminals)))
    if invalid_nets or invalid_ports or duplicate_keys:
        Report.append('WARNING: Invalid entries detected; review before running Routing Solver')
except Exception as exc:
    RoutingTerminals = []
    NetTopology = []
    Report.append('ERROR: {}'.format(exc))
# ---------- end connectivity ----------
panel_8 = Panel(connectivity.Report)
panel_9 = Panel(connectivity.RoutingTerminals)
ch_dia_editor = Python3Script(
    RoutingTerminals=flatten(connectivity.RoutingTerminals),
    Connectivity=topology_editor.ModifiedConnectivity,
    Edit=Button())  # -> ChannelDiameters, Report; inputs RoutingTerminals: list, Edit: Boolean
# ---------- ch_dia_editor: Python ----------
# AMCAD Channel Diameter Editor v12e - Y End Diameters in Both Modes - named nets + temporary Rhino viewport highlight
# Rhino 8 / Grasshopper Python 3
# INPUTS: RoutingTerminals (List, No Type Hint, Flatten), Connectivity (Item, No Type Hint), Edit (Item, bool)
# OUTPUTS: ChannelDiameters (List of JSON strings), Report (List of strings)
# Geometry is NEVER added to Rhino document. Applied values persist in a JSON sidecar.
import json
import math
import os
import tempfile
import Rhino
import Rhino.Geometry as rg
import Rhino.Display as rd
import Eto.Forms as ef
import Eto.Drawing as ed
import scriptcontext as sc
import Grasshopper as gh
from System import Action
from System.Drawing import Color

ChannelDiameters = []
Report = []

def flatten(x):
    if x is None: return []
    if hasattr(x, 'Branches'):
        return [v for b in x.Branches for v in b]
    if isinstance(x, (list, tuple)): return list(x)
    return [x]

def decode(x):
    if hasattr(x, 'Value'): x = x.Value
    if isinstance(x, str): return json.loads(x)
    return x

def section_label(p):
    s = p.get('section') or {}
    k = str(s.get('type', '')).upper()
    if k == 'CIRCLE': return 'Ø{:.2f}'.format(float(s['diameter_mm']))
    if k in ('RECTANGLE','SLOT'):
        return '{} {:.2f}x{:.2f}'.format(k, float(s['width_mm']),float(s['height_mm']))
    return k or '?'

def default_diameter(ports):
    sizes = []
    for p in ports:
        s = p.get('section') or {}
        if str(s.get('type','')).upper() == 'CIRCLE':
            sizes.append(float(s['diameter_mm']))
        else:
            sizes.append(math.hypot(float(s['width_mm']),float(s['height_mm'])))
    return max(sizes)

def make_label(txt):
    x=ef.Label(); x.Text=str(txt); return x

def make_button(txt):
    x=ef.Button(); x.Text=str(txt); return x

def make_textbox(txt):
    x=ef.TextBox(); x.Text=str(txt); return x

def terminal_key(p):
    return (str(p.get('instance_id','')),str(p.get('interface_id','')))

def node_names(graph):
    result={}
    for n in graph.get('nodes',[]):
        t=n.get('physical_terminal')
        if isinstance(t,dict):
            key=(str(t.get('instance_id','')),str(t.get('interface_id','')))
            result[key]=str(n.get('name') or n.get('port_id') or 'Unnamed port')
    return result

class NetHighlight(rd.DisplayConduit):
    def __init__(self):
        super().__init__()
        self.ports=[]
        self.names={}
    def DrawForeground(self,e):
        for p in self.ports:
            try:
                a=p['stub_endpoint']; pt=rg.Point3d(float(a[0]),float(a[1]),float(a[2]))
                direction=p.get('direction',[0,0,1]); v=rg.Vector3d(*[float(x) for x in direction]);
                if not v.Unitize(): v=rg.Vector3d(0,0,1)
                key=terminal_key(p)
                name=self.names.get(key, p.get('label','Port'))
                e.Display.DrawDot(pt, name+'  '+section_label(p),Color.Black,Color.Yellow)
                e.Display.DrawArrow(rg.Line(pt,pt+v*6.0),Color.OrangeRed,2,0.8)
            except Exception:
                continue

def redraw():
    if Rhino.RhinoDoc.ActiveDoc is not None:
        Rhino.RhinoDoc.ActiveDoc.Views.Redraw()

def request_solution(component):
    # Eto Apply is raised on Rhino's UI thread, outside the GH component solve.
    # Expire + immediate NewSolution updates downstream outputs without needing
    # a second Edit-button press. Fall back to scheduled expiry if GH is busy.
    doc=component.OnPingDocument()
    if doc is None: return
    try:
        if doc.SolutionState==gh.Kernel.GH_ProcessStep.Process:
            raise RuntimeError('GH solution is running')
        component.ExpireSolution(False)
        doc.NewSolution(False)
    except Exception:
        def expire(solution_doc):
            owner=component.OnPingDocument()
            if owner is not None and owner.DocumentID==solution_doc.DocumentID:
                owner.ExpireSolution(False)
        doc.ScheduleSolution(10,gh.Kernel.GH_Document.GH_ScheduleDelegate(expire))

def settings_path(component):
    # Save alongside the GH document, not in temporary Rhino session memory.
    doc=component.OnPingDocument()
    gh_path=str(getattr(doc,'FilePath','') or '') if doc is not None else ''
    if not gh_path:
        raise ValueError('Save the Grasshopper .gh file first; a file path is needed to persist diameters.')
    return os.path.splitext(os.path.abspath(gh_path))[0]+'.amcad_channel_diameters_'+str(component.InstanceGuid)+'.json'

def load_settings(path):
    if not os.path.isfile(path): return {}
    with open(path,'r',encoding='utf-8') as f: payload=json.load(f)
    if not isinstance(payload,dict) or not isinstance(payload.get('values'),dict):
        raise ValueError('Invalid diameter settings JSON: '+path)
    return payload['values']

def save_settings(path,values):
    # Atomic replacement protects the previous save if Rhino is interrupted.
    folder=os.path.dirname(path)
    fd,temp=tempfile.mkstemp(prefix='.amcad_diam_',suffix='.tmp',dir=folder)
    try:
        with os.fdopen(fd,'w',encoding='utf-8') as f:
            json.dump({'format':'AMCAD_CHANNEL_DIAMETERS_V1','values':values},f,indent=2,ensure_ascii=False)
            f.flush();os.fsync(f.fileno())
        os.replace(temp,path)
    finally:
        if os.path.exists(temp): os.remove(temp)

def open_window(nets,names,state,component):
    old=state.get('window')
    if old is not None and old.Visible:
        old.BringToFront(); return
    window=ef.Form()
    window.Title='AMCAD | Channel Diameter Editor v12e'
    window.ClientSize=ed.Size(790,510)
    window.Resizable=True
    # Keep modeless editor visible while interacting with Rhino viewports.
    window.Topmost=True
    conduit=NetHighlight()
    conduit.names=dict(names)
    state['conduit']=conduit
    values=state['values']
    ids=list(nets)
    selection=ef.ListBox()
    selection.DataStore=[
        'Net {}   |   {}'.format(nets[k][0].get('net_index','?'),
           '  ↔  '.join(names.get(terminal_key(p),p.get('label','Port')) for p in nets[k]))
        for k in ids]
    details=make_label('Select a connection')
    diameter=make_textbox('')
    transition=make_textbox('')
    mode=ef.DropDown()
    mode.DataStore=['Nominal + Transition', 'Linear Taper (port-to-port)']
    y_label=make_label('Y-SIDE DIAMETERS (at branch/fillet connection), mm')
    y_inputs=[make_textbox('') for _ in range(3)]
    y_rows=[]
    y_names=[make_label('Branch {}'.format(j+1)) for j in range(3)]
    for j in range(3):
        row=ef.DynamicLayout()
        row.AddRow(y_names[j],y_inputs[j])
        y_rows.append(row)
    status=make_label('Select a connection to highlight its port locations in Rhino.')
    apply=make_button('Apply')
    close=make_button('Close')
    def selected_index():
        try: return int(selection.SelectedIndex)
        except Exception: return -1
    def commit_current():
        idx=state.get('selected_index',-1)
        if idx<0 or idx>=len(ids): return True
        value=float(str(diameter.Text).strip().replace(',','.'))
        if not math.isfinite(value) or value<=0: raise ValueError('Diameter must be positive and finite')
        tr=float(str(transition.Text).strip().replace(',','.'))
        if not math.isfinite(tr) or tr<=0: raise ValueError('Transition must be > 0')
        chosen='LINEAR_TAPER' if mode.SelectedIndex==1 else 'NOMINAL'
        ports=nets[ids[idx]]
        if chosen=='LINEAR_TAPER' and len(ports) not in (2,3):
            raise ValueError('Linear Taper requires 2 or 3 ports')
        branch_ends={}
        if len(ports)==3:
            for j,port in enumerate(ports):
                v=float(str(y_inputs[j].Text).strip().replace(',','.'))
                if not math.isfinite(v) or v<=0:
                    raise ValueError('Invalid Y branch end diameter {}'.format(j+1))
                branch_ends['|'.join(terminal_key(port))]=v
        else:
            branch_ends=dict(values[ids[idx]].get('branch_end_diameters_mm',{}))
        values[ids[idx]]={'diameter':value,'transition':tr,'mode':chosen,
                          'branch_end_diameters_mm':branch_ends}
        return True
    def choose(sender=None,event=None):
        try:
            oldidx=state.get('selected_index',-1)
            idx=selected_index()
            if idx<0 or idx>=len(ids): return
            if oldidx>=0 and oldidx!=idx:
                commit_current()
            state['selected_index']=idx
            k=ids[idx]; ports=nets[k]
            details.Text='  ↔  '.join('{} ({})'.format(names.get(terminal_key(p),p.get('label','Port')),section_label(p)) for p in ports)
            v=values[k]
            diameter.Text='{:.3f}'.format(v['diameter'])
            transition.Text='{:.3f}'.format(v['transition'])
            mode.SelectedIndex=1 if v.get('mode')=='LINEAR_TAPER' else 0
            mode.Enabled=(len(ports) in (2,3))
            for j in range(3):
                if j<len(ports): y_names[j].Text=names.get(terminal_key(ports[j]),'Branch {}'.format(j+1))
                y_inputs[j].Text='{:.3f}'.format(float(v.get('branch_end_diameters_mm',{}).get(
                    '|'.join(terminal_key(ports[j])),default_diameter([ports[j]])))) if j<len(ports) else ''
            update_fields()
            diameter.Enabled=(mode.SelectedIndex==0)
            transition.Enabled=(mode.SelectedIndex==0)
            conduit.ports=list(ports)
            conduit.Enabled=True
            redraw()
            status.Text='Highlighted {} port(s) in Rhino viewport'.format(len(ports))
        except Exception as exc:
            status.Text='Input error: '+str(exc)
            # Keep old index so an invalid value cannot be silently discarded.
            if oldidx>=0: selection.SelectedIndex=oldidx
    def update_fields():
        enabled=(mode.SelectedIndex!=1)
        diameter.Enabled=enabled
        transition.Enabled=enabled
        idx=selected_index()
        y_active=(idx>=0 and idx<len(ids) and len(nets[ids[idx]])==3)
        y_label.Visible=y_active
        for j,row in enumerate(y_rows):
            row.Visible=y_active
            y_inputs[j].Enabled=y_active
    def mode_changed(sender=None,event=None):
        update_fields()
    mode.SelectedIndexChanged+=mode_changed
    def save(sender=None,event=None):
        try:
            commit_current()
            path=settings_path(component)
            save_settings(path,values)
            request_solution(component)
            status.Text='Applied and saved to: '+os.path.basename(path)
        except Exception as exc:
            status.Text='Input error: '+str(exc)
    def cleanup(sender=None,event=None):
        try:
            conduit.Enabled=False; conduit.ports=[]; redraw()
        finally:
            if state.get('window') is window: state['window']=None
            if state.get('conduit') is conduit: state['conduit']=None
    def quit_window(sender=None,event=None):
        window.Close()
    selection.SelectedIndexChanged+=choose
    apply.Click+=save
    close.Click+=quit_window
    window.Closed+=cleanup
    layout=ef.DynamicLayout()
    layout.Spacing=ed.Size(8,8)
    layout.AddRow(make_label('CONNECTIONS'))
    layout.AddRow(selection)
    layout.AddRow(make_label('SELECTED PORTS / SIZES'))
    layout.AddRow(details)
    layout.AddRow(make_label('Nominal channel diameter (mm)'),diameter)
    layout.AddRow(make_label('Transition length (mm)'),transition)
    layout.AddRow(make_label('Channel profile'),mode)
    layout.AddRow(y_label)
    for row in y_rows: layout.AddRow(row)
    layout.AddRow(status)
    actions=ef.StackLayout();actions.Orientation=ef.Orientation.Horizontal;actions.Spacing=8
    close.Size=ed.Size(90,28);apply.Size=ed.Size(90,28)
    actions.Items.Add(ef.StackLayoutItem(close));actions.Items.Add(ef.StackLayoutItem(apply))
    layout.AddRow(actions)
    window.Content=layout
    window.Show()
    state['window']=window
    if ids: selection.SelectedIndex=0
    window.BringToFront()

try:
    terminals=[decode(x) for x in flatten(RoutingTerminals)]
    nets={}
    for p in terminals:
        if not isinstance(p,dict) or not p.get('net_id'): raise ValueError('RoutingTerminals must contain net_id')
        nets.setdefault(str(p['net_id']),[]).append(p)
    graph=decode(Connectivity)
    if not isinstance(graph,dict) or not isinstance(graph.get('nodes'),list):
        raise ValueError('Connect Geometry & Placement Connectivity JSON to the new Connectivity input')
    names=node_names(graph)
    key='AMCAD_CHANNEL_DIAMETER_EDITOR_'+str(ghenv.Component.InstanceGuid)
    state=sc.sticky.get(key)
    if not isinstance(state,dict):
        state={'values':{},'pressed':False,'window':None,'selected_index':-1}
        sc.sticky[key]=state
    # Load once per GH file/component; preserve unsaved in-session edits on recompute.
    settings_file=settings_path(ghenv.Component)
    if state.get('loaded_settings_file')!=settings_file:
        state['values']=load_settings(settings_file)
        state['loaded_settings_file']=settings_file
    values=state['values']
    for net_id,ports in nets.items():
        if net_id not in values:
            values[net_id]={'diameter':default_diameter(ports),'transition':5.0,'mode':'LINEAR_TAPER'}
        if not isinstance(values[net_id],dict):
            values[net_id]={'diameter':float(values[net_id]),'transition':5.0,'mode':'LINEAR_TAPER'}
        values[net_id].setdefault('transition',5.0)
        values[net_id].setdefault('mode','LINEAR_TAPER')
        values[net_id].setdefault('branch_end_diameters_mm',{})
        values[net_id].pop('spacing',None)
        values[net_id].pop('threshold',None)
    pressed=bool(Edit)
    if pressed and not state['pressed'] and nets:
        def ui_open():
            try:
                open_window(nets,names,state,ghenv.Component)
                state['ui_error']=None
            except Exception as exc:
                conduit=state.get('conduit')
                if conduit is not None: conduit.Enabled=False
                state['window']=None
                state['ui_error']=repr(exc)
                ghenv.Component.AddRuntimeMessage(gh.Kernel.GH_RuntimeMessageLevel.Error,'UI: '+repr(exc))
            request_solution(ghenv.Component)
        Rhino.RhinoApp.InvokeOnUiThread(Action(ui_open))
    state['pressed']=pressed
    if state.get('ui_error'): Report.append('UI ERROR: '+state['ui_error'])
    Report.append('Persistent settings: '+settings_file)
    for net_id,ports in nets.items():
        ChannelDiameters.append(json.dumps({'net_id':net_id,
            'net_index':ports[0].get('net_index'),
            'channel_diameter_mm':float(values[net_id]['diameter']),
            'transition_length_mm':float(values[net_id]['transition']),
            'profile_mode':values[net_id].get('mode','LINEAR_TAPER'),
            'branch_end_diameters_mm':values[net_id].get('branch_end_diameters_mm',{})}))
        description=' ↔ '.join(names.get(terminal_key(p),p.get('label','Port')) for p in ports)
        Report.append('Net {} | {} | ports {} | nominal {:.3f} mm | mode {}'.format(
            ports[0].get('net_index','?'),description,
            ', '.join(section_label(p) for p in ports),values[net_id]['diameter'],values[net_id].get('mode','LINEAR_TAPER')))
except Exception as exc:
    Report.append('ERROR: '+repr(exc))
    ghenv.Component.AddRuntimeMessage(gh.Kernel.GH_RuntimeMessageLevel.Error,str(exc))
# ---------- end ch_dia_editor ----------
panel_10 = Panel(ch_dia_editor.Report)
junction_positioning = Python3Script(
    RoutingTerminals=flatten(connectivity.RoutingTerminals),
    OffsetX=Slider(-6, range=-50..50),
    OffsetY=Slider(12, range=-50..50),
    OffsetZ=Slider(0, range=-50..50),
    TargetNet="4")  # -> JunctionOverrides, DefaultPoints, PositionedPoints, Report; inputs RoutingTerminals: list, OffsetX: Double, OffsetY: Double, OffsetZ: Double, TargetNet: String
# ---------- junction_positioning: Python ----------
import json
import math
import Rhino.Geometry as rg

# AMCAD Junction Positioning v1
# Inputs: RoutingTerminals (List, No Type Hint, Flatten), OffsetX, OffsetY, OffsetZ (Item, float)
#         TargetNet (Item, string, optional: net_index or net_id; blank = first 3-port net)
# Outputs: JunctionOverrides (list of JSON strings), DefaultPoints, PositionedPoints, Report
JunctionOverrides, DefaultPoints, PositionedPoints, Report = [], [], [], []

def flat(x):
    if x is None: return []
    if hasattr(x, 'Branches'): return [v for b in x.Branches for v in b]
    if isinstance(x, (list, tuple)): return list(x)
    return [x]

def unwrap(x):
    if hasattr(x, 'Value'): x=x.Value
    return json.loads(x) if isinstance(x,str) else x

try:
    ports=[unwrap(x) for x in flat(RoutingTerminals)]
    nets={}
    for p in ports: nets.setdefault(str(p['net_id']), []).append(p)
    triple=[(nid, ps) for nid,ps in nets.items() if len(ps)==3]
    selector='' if TargetNet is None else str(TargetNet).strip()
    dx=0.0 if OffsetX is None else float(OffsetX)
    dy=0.0 if OffsetY is None else float(OffsetY)
    dz=0.0 if OffsetZ is None else float(OffsetZ)
    if not all(math.isfinite(x) for x in (dx,dy,dz)): raise ValueError('Offsets must be finite')
    if max(abs(dx),abs(dy),abs(dz))>100: raise ValueError('Offsets limited to +/-100 mm')
    if not selector and len(triple)>1:
        raise ValueError('Multiple 3-port nets: specify TargetNet (net_index or net_id)')
    selected=0
    for nid, ps in triple:
        idx=str(ps[0].get('net_index',''))
        coords=[p['stub_endpoint'] for p in ps]
        origin=[sum(float(p[k]) for p in coords)/3.0 for k in range(3)]
        chosen=(not selector or selector in (nid,idx))
        offsets=(dx,dy,dz) if chosen else (0.,0.,0.)
        if chosen: selected+=1
        dest=[origin[k]+offsets[k] for k in range(3)]
        DefaultPoints.append(rg.Point3d(*origin))
        PositionedPoints.append(rg.Point3d(*dest))
        JunctionOverrides.append(json.dumps({'net_id':nid,'net_index':ps[0].get('net_index'),
            'point':dest, 'default_point':origin, 'offset':list(offsets)}))
        Report.append('Net {} | default ({:.2f},{:.2f},{:.2f}) | offset ({:.2f},{:.2f},{:.2f}) | final ({:.2f},{:.2f},{:.2f})'.format(
            idx,*origin,*offsets,*dest))
    if selector and not selected: raise ValueError('TargetNet not found: '+selector)
    Report.append('{} junction(s) | selected {}'.format(len(triple),selected))
except Exception as exc:
    JunctionOverrides=[]; DefaultPoints=[]; PositionedPoints=[]
    Report.append('ERROR: '+str(exc))
# ---------- end junction_positioning ----------
panel_11 = Panel(junction_positioning.Report)
routing_solver = Python3Script(
    PreparedCavities=port_preparation.PreparedCavities,
    RoutingTerminals=connectivity.RoutingTerminals,
    WallThickness=Slider(2, range=0..10),
    MinBendRatio=Slider(2, range=0..10),
    ExitAllowance=Slider(5, range=0..10),
    JunctionOverrides=flatten(junction_positioning.JunctionOverrides),
    ChannelDiameters=flatten(ch_dia_editor.ChannelDiameters))  # -> graft(RoutedCurves), FailedRoutes, JunctionPoints, RouteMetadata, Report, DebugFailedCurves, DebugCriticalPoints; inputs PreparedCavities: tree of Brep, RoutingTerminals: list, WallThickness: Double, MinBendRatio: Double, JunctionOverrides: list, ChannelDiameters: list
# ---------- routing_solver: Python ----------
import json
import math
import heapq
import itertools
import Rhino
import Rhino.Geometry as rg

# AMCAD ROUTING SOLVER - v14 per-net channel diameters; v13 routing and Y preserved
# Inputs: PreparedCavities, RoutingTerminals, WallThickness, MinBendRatio, ExitAllowance, JunctionOverrides (List), ChannelDiameters (List)
# Outputs: RoutedCurves, FailedRoutes, JunctionPoints, Report, RouteMetadata, DebugPaths, DebugFailedCurves, DebugCriticalPoints
RoutedCurves, FailedRoutes, JunctionPoints, Report, RouteMetadata = [], [], [], [], []
DebugPaths = []  # Raw A* paths; preview only, NOT validated channels
DebugFailedCurves = []  # Best rejected full candidate per failed two-port net
DebugCriticalPoints = []  # Location of its worst sampled R/D violation
DIAG = {"best": None, "score": -1.0, "stage": None, "critical": None,
        "actual": None, "required": None, "fraction": None}

wall = max(0.0, float(WallThickness))
ratio = max(0.5, float(MinBendRatio))
exit_allowance = max(0.0, float(ExitAllowance))
tol = Rhino.RhinoDoc.ActiveDoc.ModelAbsoluteTolerance if Rhino.RhinoDoc.ActiveDoc else 0.01
SAMPLES = 24
# Inter-net channel collision check: adaptive sampling + Rhino curve closest point.
# This is a sampled engineering check, not a certified solid/continuous clearance proof.
INTER_ROUTE_SAMPLE_MM = 1.0
INTER_ROUTE_MAX_SAMPLES = 1200
ACCEPTED_CHANNELS = []  # (net_id, curve, start_radius, end_radius, nominal_radius)
ACTIVE_NET_ID = None
INTER_ROUTE_REJECTIONS = 0
HANDLE_FACTORS = (0.5, 1.0, 2.0, 3.0)
TRANSITION_MM = 5.0
MAX_FACES_PER_CAVITY = 100
# Bounded fallback. Distances in document units (expected mm).
GRID_MM = 6.0
SEARCH_MARGIN_MM = 48.0
MAX_ASTAR_NODES = 250
MAX_ASTAR_PATHS = 1
MAX_SMOOTH_TRIALS = 12
ASTAR_DIRECTIONS = [(1,0,0),(-1,0,0),(0,1,0),(0,-1,0),(0,0,1),(0,0,-1)]


def unpack(x):
    return json.loads(x) if isinstance(x, str) else x

def flatten(x):
    if x is None:
        return []
    if hasattr(x, 'Branches'):
        return [v for branch in x.Branches for v in branch]
    return list(x) if isinstance(x, (tuple, list)) else [x]

def pt(a):
    return rg.Point3d(float(a[0]), float(a[1]), float(a[2]))

def vec(a):
    v = rg.Vector3d(float(a[0]), float(a[1]), float(a[2]))
    if not v.Unitize():
        raise ValueError('Zero direction vector')
    return v

def terminal(p):
    return pt(p['stub_endpoint']), vec(p['direction']), float(p['nominal_diameter_mm'])

def section_radius(port):
    s = port.get('section', {})
    kind = str(s.get('type', '')).upper()
    if kind == 'CIRCLE':
        r = float(s['diameter_mm']) / 2.0
    elif kind in ('RECTANGLE', 'SLOT'):
        r = math.hypot(float(s['width_mm']), float(s['height_mm'])) / 2.0
    else:
        raise ValueError('Unsupported section: {}'.format(kind))
    if r <= 0:
        raise ValueError('Invalid section radius')
    return r

def route_radius(f, length, r0, r1, rn, net_id=None):
    cfg = settings_map.get(str(net_id) if net_id is not None else globals().get('ACTIVE_NET_ID'), {})
    if cfg.get('profile_mode') == 'LINEAR_TAPER':
        return r0 + (r1-r0) * max(0.0,min(1.0,f))
    transition = min(cfg.get('transition_length_mm', TRANSITION_MM), length * 0.5)
    if transition <= 1e-9: return rn
    r = rn
    if f * length < transition:
        alpha = f * length / transition
        r = max(r, r0 * (1.0-alpha) + rn * alpha)
    if (1.0-f) * length < transition:
        alpha = (1.0-f) * length / transition
        r = max(r, r1 * (1.0-alpha) + rn * alpha)
    return r

def sample(curve, fraction, length):
    if fraction <= 0:
        t = curve.Domain.T0
    elif fraction >= 1:
        t = curve.Domain.T1
    else:
        ok, t = curve.LengthParameter(length * fraction)
        if not ok:
            raise ValueError('LengthParameter failed')
    return t, curve.PointAt(t)

def radius_ok(curve, r0, r1, rn):
    length = curve.GetLength()
    if length <= 0.01:
        return False
    for i in range(SAMPLES+1):
        f = float(i)/SAMPLES
        t, _ = sample(curve, f, length)
        k = curve.CurvatureAt(t).Length
        if k > 1e-9 and 1.0/k < ratio * 2.0 * route_radius(f, length, r0, r1, rn):
            return False
    return True

def bend_diagnostic(curve, r0, r1, rn):
    """Return worst actual/required bend radius ratio and location.
    A score >= 1 means all sampled curvatures meet R/D.
    Curvature is sampled only, not a continuous guarantee.
    """
    length = curve.GetLength()
    if length <= 0.01:
        return None
    worst = float('inf')
    info = None
    for i in range(SAMPLES + 1):
        f = float(i) / SAMPLES
        t, point = sample(curve, f, length)
        k = curve.CurvatureAt(t).Length
        required = ratio * 2.0 * route_radius(f, length, r0, r1, rn)
        actual = 1.0 / k if k > 1e-9 else float('inf')
        score = actual / required if required > 0 else float('inf')
        if score < worst:
            worst = score
            info = (score, point, actual, required, f)
    return info

def track_failed(curve, r0, r1, rn, stage, segments=None):
    """Track best failed *complete* route, not merely a segment.
    Segmented curves are checked piecewise to avoid PolyCurve joint ambiguity.
    """
    checks = []
    if segments:
        total = sum(c.GetLength() for c in segments)
        progress = 0.0
        for c in segments:
            data = bend_diagnostic(c, r0, r1, rn)
            if data:
                score, point, actual, required, f = data
                checks.append((score, point, actual, required,
                               (progress + f * c.GetLength()) / max(total, 0.01)))
            progress += c.GetLength()
    else:
        data = bend_diagnostic(curve, r0, r1, rn)
        if data:
            checks.append(data)
    if not checks:
        return
    score, point, actual, required, fraction = min(checks, key=lambda x: x[0])
    # Track ONLY R/D-rejected candidates; score is minimum actual/required.
    if score < 1.0 and score > DIAG['score']:
        DIAG.update(best=curve.DuplicateCurve(), score=score, stage=stage,
                    critical=rg.Point3d(point), actual=actual,
                    required=required, fraction=fraction)

def emit_failed_diagnostic(index):
    if DIAG['best'] is None:
        Report.append('Net {}: no R/D-rejected candidate captured'.format(index))
        return
    DebugFailedCurves.append(DIAG['best'])
    DebugCriticalPoints.append(DIAG['critical'])
    Report.append('Net {}: best failed stage={} | min R/D fraction={:.3f} '
                  '| actual radius={:.2f}mm | required={:.2f}mm '
                  '| at {:.1f}% of route'.format(
                      index, DIAG['stage'], DIAG['score'], DIAG['actual'],
                      DIAG['required'], 100.0 * DIAG['fraction']))

def bbox_distance(p, b):
    dx = max(b.Min.X-p.X, 0.0, p.X-b.Max.X)
    dy = max(b.Min.Y-p.Y, 0.0, p.Y-b.Max.Y)
    dz = max(b.Min.Z-p.Z, 0.0, p.Z-b.Max.Z)
    return math.sqrt(dx*dx + dy*dy + dz*dz)

def face_distance(p, brep, threshold):
    # Bounded face closest-point tests; no mesh/Boolean.
    best = float('inf')
    for face in brep.Faces:
        fb = face.GetBoundingBox(True)
        if bbox_distance(p, fb) > min(best, threshold):
            continue
        result = face.ClosestPoint(p)
        if not result or not result[0]:
            continue
        q = face.PointAt(result[1], result[2])
        d = p.DistanceTo(q)
        if d < best:
            best = d
    return best

def channel_separation_ok(curve, r0, r1, rn, other_channels=None):
    """Check channel envelope separation ONLY between different nets.

    The three branches and three fillets of one Y net intentionally meet/overlap.
    Radius follows the same section-transition approximation as route_radius().
    """
    channels = ACCEPTED_CHANNELS if other_channels is None else other_channels
    if not channels:
        return True
    length = curve.GetLength()
    if length <= 0.01:
        return False
    for other_net, other_curve, or0, or1, orn in channels:
        if str(other_net) == str(ACTIVE_NET_ID):
            continue
        other_len = other_curve.GetLength()
        if other_len <= 0.01:
            return False
        # Two-direction sampling prevents missing close approaches on a long curve.
        for source, source_len, sr0, sr1, srn, source_net, target, target_len, tr0, tr1, trn, target_net in (
            (curve, length, r0, r1, rn, ACTIVE_NET_ID, other_curve, other_len, or0, or1, orn, other_net),
            (other_curve, other_len, or0, or1, orn, other_net, curve, length, r0, r1, rn, ACTIVE_NET_ID)):
            n = max(SAMPLES, min(INTER_ROUTE_MAX_SAMPLES,
                                 int(math.ceil(source_len / INTER_ROUTE_SAMPLE_MM))))
            for i in range(n + 1):
                f = float(i) / n
                _, point = sample(source, f, source_len)
                ok, parameter = target.ClosestPoint(point)
                if not ok:
                    return False
                nearest = target.PointAt(parameter)
                # Get normalized arclength fraction for transition radius.
                # RhinoCommon GetLength(interval) returns a float; guard domain endpoints.
                if parameter <= target.Domain.T0:
                    g = 0.0
                elif parameter >= target.Domain.T1:
                    g = 1.0
                else:
                    try:
                        g = max(0.0, min(1.0, target.GetLength(rg.Interval(target.Domain.T0, parameter)) / target_len))
                    except Exception:
                        # Conservative fallback: largest possible target radius.
                        g = None
                radius_a = route_radius(f, source_len, sr0, sr1, srn, source_net)
                radius_b = (route_radius(g, target_len, tr0, tr1, trn, target_net) if g is not None
                            else max(tr0, tr1, trn))
                if point.DistanceTo(nearest) + tol < radius_a + radius_b + wall:
                    return False
    return True


def clearance_ok(curve, obstacles, r0, r1, rn):
    length = curve.GetLength()
    if length <= 0.01:
        return False
    for i in range(SAMPLES+1):
        f = float(i)/SAMPLES
        d0, d1 = f*length, (1.0-f)*length
        if d0 <= exit_allowance or d1 <= exit_allowance:
            continue
        _, p = sample(curve, f, length)
        clearance = route_radius(f, length, r0, r1, rn) + wall
        for brep, box in obstacles:
            if bbox_distance(p, box) > clearance:
                continue  # box is only a broad-phase rejection
            if brep.IsSolid and brep.IsPointInside(p, tol, False):
                return False
            if face_distance(p, brep, clearance) < clearance:
                return False
    return channel_separation_ok(curve, r0, r1, rn)

def bezier(a, b, c, d):
    return rg.Curve.CreateControlPointCurve([a, b, c, d], 3)

def solve_pair(a, b, obstacles):
    start, da, dia_a = terminal(a)
    end, db, dia_b = terminal(b)
    dia = max(dia_a, dia_b)
    dist = start.DistanceTo(end)
    counts = {'bend': 0, 'cavity': 0, 'accepted': 0}
    if dia <= 0 or dist <= 0.01:
        return None, counts
    r0, r1, rn = section_radius(a), section_radius(b), dia/2.0
    if settings_map.get(globals().get('ACTIVE_NET_ID'),{}).get('profile_mode')=='LINEAR_TAPER': rn=max(r0,r1)
    base = max(ratio*dia, dist*0.2)
    best, best_len = None, float('inf')
    for fa in HANDLE_FACTORS:
        for fb in HANDLE_FACTORS:
            curve = bezier(start, start+da*base*fa, end+db*base*fb, end)
            track_failed(curve, r0, r1, rn, 'BEZIER')
            if not radius_ok(curve, r0, r1, rn):
                counts['bend'] += 1
                continue
            if not clearance_ok(curve, obstacles, r0, r1, rn):
                counts['cavity'] += 1
                continue
            counts['accepted'] += 1
            length = curve.GetLength()
            if length < best_len:
                best, best_len = curve, length
    return best, counts

def fallback_pair(a, b, obstacles):
    """Bounded A* between axial escape anchors; final curve must pass validation."""
    start, da, dia_a = terminal(a)
    end, db, dia_b = terminal(b)
    dia = max(dia_a, dia_b)
    r0, r1, rn = section_radius(a), section_radius(b), dia / 2.0
    if settings_map.get(globals().get('ACTIVE_NET_ID'),{}).get('profile_mode')=='LINEAR_TAPER': rn=max(r0,r1)
    clearance = max(r0, r1, rn) + wall
    step = max(GRID_MM, dia * 0.8)
    reach = max(SEARCH_MARGIN_MM, ratio * dia * 2.5)
    # A bend cannot start at the port: reserve an axial run for both ends.
    # These anchors are search seeds, NOT clearance exemptions.
    anchor_length = max(exit_allowance + step, ratio * dia * 1.5)
    anchor_a = start + da * anchor_length
    anchor_b = end + db * anchor_length
    points = [start, end, anchor_a, anchor_b]
    lo = [min(p[i] for p in points) - reach for i in range(3)]
    hi = [max(p[i] for p in points) + reach for i in range(3)]
    dims = [int(math.ceil((hi[i] - lo[i]) / step)) + 1 for i in range(3)]
    if dims[0] * dims[1] * dims[2] > 250000:
        return None, 'grid too large', 0

    def world(idx):
        return rg.Point3d(*(lo[i] + idx[i] * step for i in range(3)))

    def grid(p):
        return tuple(max(0, min(dims[i] - 1,
                     int(round((p[i] - lo[i]) / step)))) for i in range(3))

    occupancy = {}
    def free(idx):
        if idx not in occupancy:
            p = world(idx)
            allowed = True
            for brep, box in obstacles:
                if bbox_distance(p, box) > clearance:
                    continue
                if brep.IsSolid and brep.IsPointInside(p, tol, False):
                    allowed = False
                    break
                if face_distance(p, brep, clearance) < clearance:
                    allowed = False
                    break
            occupancy[idx] = allowed
        return occupancy[idx]

    def seed(anchor):
        """Choose nearby genuinely free grid cell, never force-unblock obstacles."""
        base = grid(anchor)
        candidates = []
        for dx in range(-2, 3):
            for dy in range(-2, 3):
                for dz in range(-2, 3):
                    idx = (base[0] + dx, base[1] + dy, base[2] + dz)
                    if any(idx[i] < 0 or idx[i] >= dims[i] for i in range(3)):
                        continue
                    d = world(idx).DistanceTo(anchor)
                    candidates.append((d, idx))
        for _, idx in sorted(candidates):
            if free(idx):
                return idx
        return None

    origin, goal = seed(anchor_a), seed(anchor_b)
    if origin is None or goal is None:
        return None, ('A* seed blocked: start={} goal={} | occupancy={}'
                      .format(origin is not None, goal is not None, len(occupancy))), 0

    def h(idx):
        return math.sqrt(sum((idx[i] - goal[i]) ** 2 for i in range(3)))

    def segment_free(i0, i1):
        # No diagonal corner-cutting through occupied cells.
        p0, p1 = world(i0), world(i1)
        for f in (0.5,):
            p = p0 + (p1 - p0) * f
            for brep, box in obstacles:
                if bbox_distance(p, box) > clearance:
                    continue
                if brep.IsSolid and brep.IsPointInside(p, tol, False):
                    return False
                if face_distance(p, brep, clearance) < clearance:
                    return False
        return True

    best, bestlen = None, float('inf')
    smooth_rejects = {'bend': 0, 'cavity': 0, 'invalid': 0, 'pass': 0}
    total_expanded, attempts = 0, 0
    reached_count = 0
    for variant in range(MAX_ASTAR_PATHS):
        counter = itertools.count()
        queue = [(h(origin), next(counter), origin)]
        gscore = {origin: 0.0}
        parent, closed = {}, set()
        reached = False
        while queue and len(closed) < MAX_ASTAR_NODES:
            _, _, cur = heapq.heappop(queue)
            if cur in closed:
                continue
            closed.add(cur)
            if cur == goal:
                reached = True
                break
            for move in ASTAR_DIRECTIONS:
                nxt = tuple(cur[i] + move[i] for i in range(3))
                if any(nxt[i] < 0 or nxt[i] >= dims[i] for i in range(3)):
                    continue
                if nxt in closed or not free(nxt) or not segment_free(cur, nxt):
                    continue
                cost = math.sqrt(sum(v*v for v in move))
                cost *= 1.0 + 0.12 * max(0, move[variant])
                new = gscore[cur] + cost
                if new < gscore.get(nxt, float('inf')):
                    gscore[nxt], parent[nxt] = new, cur
                    heapq.heappush(queue, (new + h(nxt), next(counter), nxt))
        total_expanded += len(closed)
        if not reached:
            continue
        reached_count += 1
        indices = [goal]
        while indices[-1] != origin:
            indices.append(parent[indices[-1]])
        indices.reverse()
        # Visual diagnostic: full grid route plus axial anchors.
        # It is NOT a channel and is NOT curvature/clearance validated.
        debug_points = [start, anchor_a] + [world(idx) for idx in indices] + [anchor_b, end]
        debug_dedup = [debug_points[0]]
        for debug_p in debug_points[1:]:
            if debug_p.DistanceTo(debug_dedup[-1]) > 0.01:
                debug_dedup.append(debug_p)
        if len(debug_dedup) >= 2:
            DebugPaths.append(rg.PolylineCurve(debug_dedup))
        simplified = [indices[0]]
        for k in range(1, len(indices)-1):
            prev, curr, nxt = indices[k-1], indices[k], indices[k+1]
            v1 = tuple(curr[i]-prev[i] for i in range(3))
            v2 = tuple(nxt[i]-curr[i] for i in range(3))
            if v1 != v2:
                simplified.append(curr)
        simplified.append(indices[-1])
        # Explicit axial anchors preserve correct exit and entry directions.
        raw = [start, anchor_a] + [world(idx) for idx in simplified] + [anchor_b, end]
        dedup = [raw[0]]
        for p in raw[1:]:
            if p.DistanceTo(dedup[-1]) > 0.1:
                dedup.append(p)
        for stride in (1, 2, 3):
            mids = dedup[2:-2:stride]
            waypoints = [start, anchor_a] + mids + [anchor_b, end]
            for handle_factor in (0.25, 0.4):
                if attempts >= MAX_SMOOTH_TRIALS:
                    break
                attempts += 1
                tangents = []
                for j, p in enumerate(waypoints):
                    if j in (0, 1):
                        t = rg.Vector3d(da)
                    elif j in (len(waypoints)-2, len(waypoints)-1):
                        t = -rg.Vector3d(db)
                    else:
                        t = waypoints[j+1] - waypoints[j-1]
                        if not t.Unitize():
                            break
                    tangents.append(t)
                if len(tangents) != len(waypoints):
                    smooth_rejects['invalid'] += 1
                    continue
                pieces = []
                for j in range(len(waypoints)-1):
                    p0, p3 = waypoints[j], waypoints[j+1]
                    d = p0.DistanceTo(p3)
                    if d < 0.01:
                        break
                    handle = d * handle_factor
                    pieces.append(bezier(p0, p0 + tangents[j]*handle,
                                         p3 - tangents[j+1]*handle, p3))
                if len(pieces) != len(waypoints)-1:
                    smooth_rejects['invalid'] += 1
                    continue
                poly = rg.PolyCurve()
                for piece in pieces:
                    poly.Append(piece)
                track_failed(poly, r0, r1, rn, 'ASTAR_SMOOTH', pieces)
                if not all(radius_ok(piece, r0, r1, rn) for piece in pieces):
                    smooth_rejects['bend'] += 1
                    continue
                if not clearance_ok(poly, obstacles, r0, r1, rn):
                    smooth_rejects['cavity'] += 1
                    continue
                smooth_rejects['pass'] += 1
                length = poly.GetLength()
                if length < bestlen:
                    best, bestlen = poly, length
    detail = ('A* expanded={} | reached={} | smooth trials={} | occupancy={} '
              '| seeds=free/free | axial={:.1f}mm | smooth R/D reject={} '
              '| smooth Brep reject={} | invalid={} | pass={}'.format(
                  total_expanded, reached_count, attempts,
                  len(occupancy), anchor_length, smooth_rejects['bend'],
                  smooth_rejects['cavity'], smooth_rejects['invalid'],
                  smooth_rejects['pass']))
    return best, detail, total_expanded


# Maneuver search: bounded, three-dimensional lateral detours.
# A candidate consists of two cubic segments with a common waypoint tangent.
# This does not guarantee a solution; candidates must pass sampled checks.
MANEUVER_SCALES = (1.5, 2.5, 4.0)
MANEUVER_HANDLES = (0.45, 0.7)
MAX_MANEUVER_TRIALS = 36

def maneuver_pair(a, b, obstacles):
    start, da, dia_a = terminal(a)
    end, db, dia_b = terminal(b)
    diameter = max(dia_a, dia_b)
    r0, r1, rn = section_radius(a), section_radius(b), diameter / 2.0
    if settings_map.get(globals().get('ACTIVE_NET_ID'),{}).get('profile_mode')=='LINEAR_TAPER': rn=max(r0,r1)
    required = ratio * 2.0 * max(r0, r1, rn)
    delta = end - start
    if delta.Length < 0.01:
        return None, 'degenerate endpoints'
    direction = rg.Vector3d(delta)
    direction.Unitize()
    # Choose transverse basis robustly, even when the port axis is near Z.
    reference = rg.Vector3d.ZAxis if abs(direction.Z) < 0.85 else rg.Vector3d.XAxis
    u = rg.Vector3d.CrossProduct(direction, reference)
    if not u.Unitize():
        return None, 'invalid lateral basis'
    v = rg.Vector3d.CrossProduct(direction, u)
    v.Unitize()
    transverse = (u, -u, v, -v, (u + v), (u - v))
    count = {'bend':0, 'cavity':0, 'invalid':0, 'pass':0}
    best, best_length = None, float('inf')
    trials = 0
    # A lateral waypoint permits a genuine detour, not just a longer handle.
    midpoint = start + delta * 0.5
    for scale in MANEUVER_SCALES:
        for lateral in transverse:
            lateral = rg.Vector3d(lateral)
            if not lateral.Unitize():
                continue
            waypoint = midpoint + lateral * required * scale
            # Tangent at waypoint follows the chord from start to end.
            # Both segments use the SAME tangent, ensuring G1 continuity.
            tangent = rg.Vector3d(direction)
            for hf in MANEUVER_HANDLES:
                if trials >= MAX_MANEUVER_TRIALS:
                    break
                trials += 1
                d1 = start.DistanceTo(waypoint)
                d2 = waypoint.DistanceTo(end)
                if min(d1, d2) < 0.01:
                    count['invalid'] += 1
                    continue
                c1 = bezier(start, start + da * d1 * hf,
                            waypoint - tangent * d1 * hf, waypoint)
                c2 = bezier(waypoint, waypoint + tangent * d2 * hf,
                            end + db * d2 * hf, end)
                # Validate curvature per segment: PolyCurve.CurvatureAt can
                # conceal a bad joint in RhinoCommon.
                candidate = rg.PolyCurve()
                candidate.Append(c1)
                candidate.Append(c2)
                track_failed(candidate, r0, r1, rn, 'MANEUVER', (c1, c2))
                if not radius_ok(c1, r0, r1, rn) or not radius_ok(c2, r0, r1, rn):
                    count['bend'] += 1
                    continue
                poly = rg.PolyCurve()
                poly.Append(c1)
                poly.Append(c2)
                if not clearance_ok(poly, obstacles, r0, r1, rn):
                    count['cavity'] += 1
                    continue
                count['pass'] += 1
                length = poly.GetLength()
                if length < best_length:
                    best, best_length = poly, length
    detail = ('maneuver trials={} | R/D reject={} | Brep reject={} '
              '| invalid={} | pass={}'.format(trials, count['bend'],
              count['cavity'], count['invalid'], count['pass']))
    return best, detail

def tangent_y_junction(ports):
    data = [terminal(p) for p in ports]
    points = [x[0] for x in data]
    junction = rg.Point3d(sum(p.X for p in points)/3.0,
                          sum(p.Y for p in points)/3.0,
                          sum(p.Z for p in points)/3.0)
    curves, used = [], []
    for port, (start, axis, dia) in zip(ports, data):
        delta = junction-start
        dist = delta.Length
        if dist <= 0.01:
            continue
        toward = rg.Vector3d(delta)
        toward.Unitize()
        handle = min(dist*0.30, max(ratio*dia, 10.0))
        curves.append(bezier(start, start+axis*handle,
                             junction-toward*handle, junction))
        used.append(port)
    return curves, used, junction

def planar_y_normal(ports, junction):
    """Normal = mean of normalized approaches; Mercedes fallback = cross product."""
    starts = [terminal(p)[0] for p in ports]
    directions = []
    for start in starts:
        direction = junction - start
        if direction.Length < 0.01 or not direction.Unitize():
            raise ValueError('Junction coincides with a port')
        directions.append(direction)
    mean = rg.Vector3d(0, 0, 0)
    for direction in directions:
        mean += direction
    mean_size = mean.Length
    if mean_size > 0.10:
        mean.Unitize()
        return mean, 'MEAN', mean_size
    crosses = []
    for i, j in ((0, 1), (0, 2), (1, 2)):
        cross = rg.Vector3d.CrossProduct(directions[i], directions[j])
        crosses.append((cross.Length, cross))
    magnitude, normal = max(crosses, key=lambda x: x[0])
    if magnitude < 0.05:
        raise ValueError('Mean approaches cancel but are nearly collinear; no stable plane')
    normal.Unitize()
    return normal, 'MERCEDES_CROSS', mean_size


def manual_y_junction(ports, junction, obstacles):
    """Three cubic Beziers: port-axis start tangent and coplanar terminal tangents.

    Endpoint control handles are optimized independently; no forced straight
    segment. Curvature and cavity checks remain sampled, not exact proofs.
    """
    counts = {'bend':0, 'cavity':0, 'degenerate':0,
              'valid':0, 'trials':0, 'details':[]}
    try:
        normal, mode, mean_size = planar_y_normal(ports, junction)
    except ValueError as exc:
        counts['degenerate'] = 1
        counts['details'].append('plane unavailable: {}'.format(exc))
        return [], counts, rg.Vector3d(0,0,0), 0.0
    counts['details'].append('plane mode={} | approach vector sum length={:.4f}'.format(
        mode, mean_size))
    curves, arrivals = [], []
    for i, port in enumerate(ports):
        start, axis, dia = terminal(port)
        approach = junction - start
        distance = approach.Length
        if distance < 0.01:
            counts['degenerate'] += 1
            return [], counts, normal, 0.0
        approach.Unitize()
        arrival = rg.Vector3d(approach)
        arrival -= normal * (arrival * normal)
        if not arrival.Unitize():
            # A radial approach parallel to the plane normal has no unique
            # projected tangent. Try the physical port exit axis first.
            arrival = rg.Vector3d(axis)
            arrival -= normal * (arrival * normal)
            if not arrival.Unitize():
                # Deterministic geometric fallback from another port's
                # projected direction; no arbitrary world-axis orientation.
                for other in ports:
                    other_start = terminal(other)[0]
                    candidate = junction - other_start
                    candidate -= normal * (candidate * normal)
                    if candidate.Unitize():
                        arrival = candidate
                        break
                else:
                    counts['degenerate'] += 1
                    counts['details'].append('branch {}: no stable arrival tangent'.format(i+1))
                    return [], counts, normal, 0.0
        arrivals.append(arrival)
        r0, rn = section_radius(port), dia/2.0
        required = ratio * 2.0 * max(r0, rn)
        best_valid, best_preview = None, None
        valid_length, best_score = float('inf'), -1.0
        best_preview_radius = 0.0
        local = {'bend':0,'cavity':0,'pass':0,'trials':0}
        # 25 bounded combinations per branch. Both endpoint handles are free.
        for h0 in (0.15, 0.25, 0.40, 0.65, 1.0):
            for h1 in (0.15, 0.25, 0.40, 0.65, 1.0):
                local['trials'] += 1
                curve = bezier(start,
                               start + axis * distance * h0,
                               junction - arrival * distance * h1,
                               junction)
                if curve is None or not curve.IsValid:
                    continue
                diagnostic = bend_diagnostic(curve, r0, rn, rn)
                score = diagnostic[0] if diagnostic else 0.0
                if score > best_score:
                    best_score = score
                    best_preview = curve
                    best_preview_radius = diagnostic[2] if diagnostic else 0.0
                if not radius_ok(curve, r0, rn, rn):
                    local['bend'] += 1
                    continue
                if not clearance_ok(curve, obstacles, r0, rn, rn):
                    local['cavity'] += 1
                    continue
                local['pass'] += 1
                length = curve.GetLength()
                if length < valid_length:
                    valid_length = length
                    best_valid = curve
        counts['trials'] += local['trials']
        if best_valid is not None:
            curves.append(best_valid)
            counts['valid'] += 1
            status = 'VALID'
            diag = bend_diagnostic(best_valid, r0, rn, rn)
            score = diag[0] if diag else 0.0
            actual = diag[2] if diag else 0.0
        elif best_preview is not None:
            curves.append(best_preview)
            if best_score < 1.0:
                counts['bend'] += 1
            else:
                counts['cavity'] += 1
            status = 'PREVIEW ONLY'
            score, actual = best_score, best_preview_radius
        else:
            counts['degenerate'] += 1
            return [], counts, normal, 0.0
        counts['details'].append(
            'branch {}: {} | trials={} | bend rejects={} | cavity rejects={} '
            '| passes={} | min R/required={:.3f} | sampled min R={:.2f}mm '
            '| required R>={:.2f}mm'.format(
                i+1, status, local['trials'], local['bend'], local['cavity'],
                local['pass'], score, actual, required))
    triple = abs(arrivals[0] * rg.Vector3d.CrossProduct(arrivals[1], arrivals[2]))
    return curves, counts, normal, triple


# Junction corner cutback: distance measured along each original branch
# from the virtual J point. Not a physical fillet radius.
JUNCTION_CUTBACK_MM = 6.0
JUNCTION_MIN_BRANCH_MM = 1.0
FILLET_HANDLE_FACTORS = (0.12, 0.20, 0.30, 0.45, 0.60)

def length_parameter(curve, distance):
    length = curve.GetLength()
    if distance <= 0:
        return curve.Domain.T0
    if distance >= length:
        return curve.Domain.T1
    ok, t = curve.LengthParameter(distance)
    if not ok:
        raise ValueError('LengthParameter failed for Y cutback')
    return t

def cutback_y_branch(curve, distance):
    length = curve.GetLength()
    if length <= distance + JUNCTION_MIN_BRANCH_MM:
        raise ValueError('Y branch too short ({:.2f}mm) for {:.2f}mm cutback'.format(
            length, distance))
    t = length_parameter(curve, length - distance)
    shortened = curve.Trim(curve.Domain.T0, t)
    if shortened is None or not shortened.IsValid:
        raise ValueError('Could not trim Y branch')
    tangent = rg.Vector3d(curve.TangentAt(t))
    if not tangent.Unitize():
        raise ValueError('Invalid tangent at Y cutback')
    return shortened, shortened.PointAtEnd, tangent

def best_y_fillet(a, b, tangent_a, tangent_b, diameter, end_diameter=None):
    """Cubic bridge with branch tangent directions at both ends.

    A->B starts toward virtual J (+tangent_a) and ends pointing away
    from virtual J (-tangent_b). Sampled bend scores are diagnostics;
    a preview is returned even if no candidate passes the bend limit.
    """
    if end_diameter is None: end_diameter=diameter
    chord = a.DistanceTo(b)
    if chord <= 0.01:
        raise ValueError('Coincident fillet endpoints')
    best_valid = None
    best_preview = None
    shortest = float('inf')
    highest_score = -1.0
    best_preview_score = -1.0
    for factor in FILLET_HANDLE_FACTORS:
        handle = chord * factor
        candidate = bezier(a, a + tangent_a * handle,
                           b + tangent_b * handle, b)
        if candidate is None or not candidate.IsValid:
            continue
        diag = bend_diagnostic(candidate, diameter/2.0,
                               end_diameter/2.0, max(diameter,end_diameter)/2.0)
        score = diag[0] if diag else 0.0
        if score > highest_score:
            highest_score = score
            best_preview = candidate
            best_preview_score = score
        if score >= 1.0 and candidate.GetLength() < shortest:
            shortest = candidate.GetLength()
            best_valid = candidate
    if best_valid is not None:
        return best_valid, True, highest_score
    if best_preview is not None:
        return best_preview, False, best_preview_score
    raise ValueError('No valid Bezier construction for fillet')

def fillet_port(diameter, label):
    """Synthetic nominal-circle port for existing Channel Geometry."""
    return {'instance_id': 'JUNCTION', 'interface_id': label,
            'section': {'type': 'CIRCLE', 'diameter_mm': diameter},
            'section_u': None, 'section_v': None,
            'stub_endpoint': None, 'direction': None,
            'nominal_diameter_mm': diameter}

def override_lookup(raw):
    found={}
    for x in flatten(raw):
        d=unpack(x.Value if hasattr(x,'Value') else x)
        if not isinstance(d,dict): raise ValueError('Invalid junction override')
        key=str(d['net_id'])
        coords=d['point']
        if len(coords)!=3 or not all(math.isfinite(float(v)) for v in coords):
            raise ValueError('Invalid override coordinates for '+key)
        if key in found: raise ValueError('Duplicate junction override '+key)
        found[key]=pt(coords)
    return found

def section_data(port):
    return {k: port.get(k) for k in ('instance_id', 'interface_id', 'section',
                                    'section_u', 'section_v', 'stub_endpoint', 'direction')}

def append_route(curve, net_id, net_index, kind, start, end=None):
    length = curve.GetLength()
    nominal = max(float(start.get('nominal_diameter_mm', 0)),
                  float(end.get('nominal_diameter_mm', 0)) if end else 0)
    meta = {'route_index': len(RoutedCurves), 'net_id': str(net_id),
            'net_index': net_index, 'route_type': kind,
            'start_port': section_data(start),
            'end_port': section_data(end) if end else None,
            'nominal_diameter_mm': nominal, 'length_mm': length,
            'use_nominal_section': True,
            'transition_length_mm': min(settings_map[str(net_id)]['transition_length_mm'], length*0.5),
            'profile_mode': ('LINEAR_TAPER' if kind=='JUNCTION_FILLET' else settings_map[str(net_id)]['profile_mode']),
            'min_bend_ratio': ratio,
            'clearance_validation': 'SAMPLED_BREP_AND_INTER_NET' if kind == 'PAIR' else 'SAMPLED_INTER_NET_ONLY_Y_OTHER_CHECKS_MAY_BE_PREVIEW'}
    RoutedCurves.append(curve)
    RouteMetadata.append(json.dumps(meta))
    ACCEPTED_CHANNELS.append((str(net_id), curve, section_radius(start),
                              section_radius(end) if end else nominal / 2.0, nominal / 2.0))

try:
    cavities = [x for x in flatten(PreparedCavities) if isinstance(x, rg.Brep)]
    for i, b in enumerate(cavities):
        if b.Faces.Count > MAX_FACES_PER_CAVITY:
            raise ValueError('Cavity {} exceeds {} faces; skipped for safety'.format(i, MAX_FACES_PER_CAVITY))
    obstacles = [(b, b.GetBoundingBox(True)) for b in cavities]
    terminals = [unpack(x) for x in flatten(RoutingTerminals)]
    overrides = override_lookup(JunctionOverrides)
    # ChannelDiameters is supplied by the separate button-driven diameter editor.
    # Strict matching by stable net_id, not by transient net_index.
    diameter_map = {}
    settings_map = {}
    for raw in flatten(ChannelDiameters):
        entry = unpack(raw.Value if hasattr(raw, 'Value') else raw)
        if isinstance(entry, list):
            entries = entry
        elif isinstance(entry, dict) and 'diameters' in entry:
            entries = entry['diameters']
        else:
            entries = [entry]
        for d in entries:
            if not isinstance(d, dict):
                raise ValueError('ChannelDiameters must contain JSON objects')
            key = str(d['net_id'])
            diameter = float(d['channel_diameter_mm'])
            if not math.isfinite(diameter) or diameter <= 0:
                raise ValueError('Invalid channel diameter for net ' + key)
            if key in diameter_map:
                raise ValueError('Duplicate channel diameter for net ' + key)
            diameter_map[key] = diameter
            settings_map[key] = {}
            mode=str(d.get('profile_mode','NOMINAL')).upper()
            if mode not in ('NOMINAL','LINEAR_TAPER'):
                raise ValueError('Unknown profile_mode for net '+key)
            settings_map[key]['profile_mode']=mode
            raw_ends=d.get('branch_end_diameters_mm',{})
            if not isinstance(raw_ends,dict): raise ValueError('Invalid Y branch diameter map')
            ends={}
            for term_key,diam in raw_ends.items():
                dv=float(diam)
                if not math.isfinite(dv) or dv<=0: raise ValueError('Invalid Y end diameter')
                ends[str(term_key)]=dv
            settings_map[key]['branch_end_diameters_mm']=ends
            for field, default, allow_zero in (('transition_length_mm',5.0,False),):
                val=float(d.get(field,default))
                if not math.isfinite(val) or val<0 or (not allow_zero and val==0):
                    raise ValueError('Invalid {} for net {}'.format(field,key))
                settings_map[key][field]=val
    nets = {}
    for x in terminals:
        nets.setdefault(str(x['net_id']), []).append(x)
    for net_id, ports in nets.items():
        if settings_map.get(net_id,{}).get('profile_mode')=='LINEAR_TAPER':
            if len(ports) not in (2,3): raise ValueError('Linear Taper requires 2 or 3 ports on net '+net_id)

            if any(str(p.get('section',{}).get('type','')).upper()!='CIRCLE' for p in ports):
                raise ValueError('Linear Taper currently requires CIRCLE ports on net '+net_id)
        if len(ports)==3:
            endmap=settings_map[net_id]['branch_end_diameters_mm']
            # Legacy editors have no Y-end fields: use the existing shared nominal
            # diameter as the initial value, but always accept explicit per-port values.
            for port in ports:
                termkey=str(port.get('instance_id',''))+'|'+str(port.get('interface_id',''))
                if termkey not in endmap:
                    endmap[termkey]=diameter_map.get(net_id,0.0)
        if net_id not in diameter_map:
            raise ValueError('Missing ChannelDiameters entry for net ' + net_id +
                             '; use the diameter editor to assign every net')
        # Do not mutate upstream terminal dictionaries. Every port in the same
        # net receives the same route nominal diameter; its physical section stays.
        for i, port in enumerate(ports):
            local = dict(port)
            local['nominal_diameter_mm'] = diameter_map[net_id]
            if len(ports)==3:
                termkey=str(port.get('instance_id',''))+'|'+str(port.get('interface_id',''))
                local['nominal_diameter_mm']=settings_map[net_id]['branch_end_diameters_mm'][termkey]
            ports[i] = local
    extra = set(diameter_map) - set(nets)
    if extra:
        Report.append('WARNING: {} diameter entries refer to inactive nets'.format(len(extra)))
    Report.append('Profile modes: '+', '.join('Net {} = {}'.format(ports[0].get('net_index','?'),settings_map[net_id]['profile_mode']) for net_id,ports in nets.items()))
    Report.append('Nominal diameters: ' + ', '.join(
        'Net {} = {:.3f} mm'.format(ports[0].get('net_index', '?'), diameter_map[net_id])
        for net_id, ports in nets.items()))
    Report.append('{} cavities | {} terminals | {} nets'.format(
        len(cavities), len(terminals), len(nets)))
    for net_id, ports in nets.items():
        ACTIVE_NET_ID = str(net_id)
        index = ports[0].get('net_index', '?')
        if len(ports) == 2:
            DIAG.update(best=None, score=-1.0, stage=None, critical=None,
                        actual=None, required=None, fraction=None)
            curve, counts = solve_pair(ports[0], ports[1], obstacles)
            Report.append('Net {}: 16 candidates | R/D reject={} | Brep reject={} | pass={}'.format(
                index, counts['bend'], counts['cavity'], counts['accepted']))
            if curve is None:
                curve, detail, expanded = fallback_pair(ports[0], ports[1], obstacles)
                Report.append('Net {}: fallback {}'.format(index,detail))
            if curve is None:
                curve, maneuver_detail = maneuver_pair(ports[0], ports[1], obstacles)
                Report.append('Net {}: {}'.format(index, maneuver_detail))
            if curve:
                append_route(curve, net_id, index, 'PAIR', ports[0], ports[1])
                Report.append('Net {}: routed {:.1f} mm'.format(index, curve.GetLength()))
            else:
                a, b = terminal(ports[0])[0], terminal(ports[1])[0]
                if a.DistanceTo(b) > 0.01:
                    FailedRoutes.append(rg.LineCurve(a, b))
                Report.append('Net {}: no validated route after Bezier + A* + maneuver'.format(index))
                emit_failed_diagnostic(index)
        elif len(ports) == 3:
            data=[terminal(p)[0] for p in ports]
            centroid=rg.Point3d(sum(p.X for p in data)/3.0,
                                sum(p.Y for p in data)/3.0,
                                sum(p.Z for p in data)/3.0)
            junction=overrides.get(net_id,centroid)
            curves, counts, plane_normal, planar_error=manual_y_junction(ports,junction,obstacles)
            Report.append('Net {}: Y target ({:.2f},{:.2f},{:.2f}) | offset {:.2f}mm | R/D failures={} | cavity failures={} | degenerate={}'.format(
                index,junction.X,junction.Y,junction.Z,junction.DistanceTo(centroid),
                counts['bend'],counts['cavity'],counts['degenerate']))
            Report.extend('Net {}: {}'.format(index, d) for d in counts['details'])
            Report.append('Net {}: planar arrival tangents | normal=({:.3f},{:.3f},{:.3f}) | triple product={:.3e}'.format(
                index,plane_normal.X,plane_normal.Y,plane_normal.Z,planar_error))
            # Preview unvalidated Y when no candidate meets checks, explicitly labelled.
            # Useful for manual 3DOF tuning; never call this a validated route.
            if len(curves)==3:
                # Build all six curves locally first: avoid half-emitted nets
                # when one cutback/bridge cannot be constructed.
                try:
                    cut_data = [cutback_y_branch(c, JUNCTION_CUTBACK_MM) for c in curves]
                    diameter = max(float(p['nominal_diameter_mm']) for p in ports)
                    pairs = ((0, 1), (1, 2), (2, 0))
                    fillets = []
                    fillet_valid = []
                    for a, b in pairs:
                        bridge, valid, score = best_y_fillet(
                            cut_data[a][1], cut_data[b][1],
                            cut_data[a][2], cut_data[b][2],
                            float(ports[a]['nominal_diameter_mm']),
                            float(ports[b]['nominal_diameter_mm']))
                        fillets.append(bridge)
                        fillet_valid.append(valid)
                        Report.append('Net {}: fillet {}-{} | {:.2f}mm | sampled bend {} | R/required {:.3f}'.format(
                            index, a+1, b+1, bridge.GetLength(),
                            'PASS' if valid else 'PREVIEW ONLY', score))
                    # Cross-net check of all Y parts, including fillets. Same-net
                    # intersections are intentional at the junction and exempt.
                    y_parts = [(c, section_radius(port), float(port['nominal_diameter_mm'])/2.0,
                                float(port['nominal_diameter_mm'])/2.0)
                               for c, port in zip((item[0] for item in cut_data), ports)]
                    for (a,b),bridge in zip(pairs,fillets):
                        da=float(ports[a]['nominal_diameter_mm'])
                        db=float(ports[b]['nominal_diameter_mm'])
                        y_parts.append((bridge, da/2.0, db/2.0, max(da,db)/2.0))
                    if not all(channel_separation_ok(c, ra, rb, rn) for c, ra, rb, rn in y_parts):
                        raise ValueError('Y intersects another net or violates inter-net wall thickness')
                    JunctionPoints.append(junction)
                    for (short_curve, _, _), port in zip(cut_data, ports):
                        append_route(short_curve, net_id, index, 'JUNCTION_BRANCH', port)
                    for (a, b), bridge in zip(pairs, fillets):
                        da=float(ports[a]['nominal_diameter_mm'])
                        db=float(ports[b]['nominal_diameter_mm'])
                        synthetic = fillet_port(da,
                                                'FILLET_{}_{}'.format(a+1,b+1)+'_START')
                        synthetic_end = fillet_port(db,
                                                    'FILLET_{}_{}'.format(a+1,b+1)+'_END')
                        append_route(bridge, net_id, index, 'JUNCTION_FILLET', synthetic, synthetic_end)
                    Report.append('Net {}: Y emitted 3 trimmed branches + 3 fillets | cutback {:.2f}mm'.format(
                        index, JUNCTION_CUTBACK_MM))
                    if counts['bend'] or counts['cavity'] or not all(fillet_valid):
                        Report.append('Net {}: Y PREVIEW ONLY; some sampled checks failed'.format(index))
                    else:
                        Report.append('Net {}: branch and fillet sampled bend checks PASS; junction clearance NOT VALIDATED'.format(index))
                except Exception as exc:
                    Report.append('Net {}: Y NOT EMITTED | {}'.format(index, exc))
            else:
                Report.append('Net {}: Y not emitted (degenerate target)'.format(index))
        else:
            Report.append('Net {}: {} terminals unsupported'.format(index, len(ports)))
    Report.append('Routed curves: {} | Route metadata: {} | DebugPaths: {} | DebugFailedCurves: {} | DebugCriticalPoints: {}'.format(len(RoutedCurves), len(RouteMetadata), len(DebugPaths), len(DebugFailedCurves), len(DebugCriticalPoints)))
    Report.append('PAIR: Bezier + axial-seed A* + bounded 3D maneuver; sampled R/D and Brep clearance; no Boolean.')
    Report.append('Y: 3 cutback branches + 3 tangent Bezier fillets directly in RoutedCurves; bounded 25 trials/branch.')
    Report.append('Inter-net channel walls checked against previously accepted routes (sampled); same-net Y joins exempt.')
    Report.append('Y output may be preview-only for bend/cavity failures; final-solid validation not performed.')
except Exception as exc:
    Report.append('ERROR: {}'.format(exc))
# ---------- end routing_solver ----------
panel_12 = Panel(routing_solver.Report)
pt = Point(routing_solver.JunctionPoints)
crv = Curve(routing_solver.RoutedCurves)
channel_geometry = Python3Script(RoutedCurves=flatten(crv), RouteMetadata=routing_solver.RouteMetadata, SectionSpacing=Slider(0.1, range=0..10))  # -> ChannelBreps, SectionCurves, Report; inputs RoutedCurves: list of Curve, RouteMetadata: list, SectionSpacing: Double
# ---------- channel_geometry: Python ----------
# AMCAD Channel Geometry v6b - All channel ends open
# Rhino 8 / Grasshopper Python 3
# Inputs: RoutedCurves (List), RouteMetadata (List), SectionSpacing (Item, optional)
# Outputs: ChannelBreps, SectionCurves, Report
# Y branch curves (JUNCTION_BRANCH) are lofted only to their existing end circles.
# Y fillet curves (JUNCTION_FILLET) are excluded; Three-Circle Loft v7 supplies the junction.
# NO planar caps on ANY route. All lofts remain open surfaces.
import json
import math
import Rhino
import Rhino.Geometry as rg

ChannelBreps=[]
SectionCurves=[]
Report=[]
MAX_SECTIONS=64

def flatten(x):
    if x is None: return []
    if hasattr(x,'Branches'): return [v for b in x.Branches for v in b]
    return list(x) if isinstance(x,(list,tuple)) else [x]

def unit(v):
    v=rg.Vector3d(v)
    if not v.Unitize(): raise ValueError('Zero vector')
    return v

def perp(t,hint):
    t=unit(t)
    options=[]
    if hint is not None: options.append(rg.Vector3d(float(hint[0]),float(hint[1]),float(hint[2])))
    options.extend((rg.Vector3d.XAxis,rg.Vector3d.YAxis,rg.Vector3d.ZAxis))
    for x in options:
        u=rg.Vector3d(x);u-=t*(u*t)
        if u.Unitize(): return u
    raise ValueError('Cannot create section frame')

def section_curve(spec,plane):
    k=str(spec.get('type','')).upper()
    if k=='CIRCLE': return rg.Circle(plane,float(spec['diameter_mm'])/2).ToNurbsCurve()
    if k=='RECTANGLE':
        w=float(spec['width_mm']);h=float(spec['height_mm'])
        return rg.Rectangle3d(plane,rg.Interval(-w/2,w/2),rg.Interval(-h/2,h/2)).ToNurbsCurve()
    if k=='SLOT':
        w=float(spec['width_mm']);h=float(spec['height_mm']);r=min(w,h)/2;a=abs(w-h)/2
        if a<1e-8:return rg.Circle(plane,r).ToNurbsCurve()
        def pt(x,y):return plane.PointAt(x,y)
        if w>=h:
            pieces=[rg.LineCurve(pt(-a,-r),pt(a,-r)),rg.ArcCurve(rg.Arc(pt(a,-r),pt(a+r,0),pt(a,r))),rg.LineCurve(pt(a,r),pt(-a,r)),rg.ArcCurve(rg.Arc(pt(-a,r),pt(-a-r,0),pt(-a,-r)))]
        else:
            pieces=[rg.LineCurve(pt(r,-a),pt(r,a)),rg.ArcCurve(rg.Arc(pt(r,a),pt(0,a+r),pt(-r,a))),rg.LineCurve(pt(-r,a),pt(-r,-a)),rg.ArcCurve(rg.Arc(pt(-r,-a),pt(0,-a-r),pt(r,-a)))]
        joined=rg.Curve.JoinCurves(pieces,0.01)
        if len(joined)!=1 or not joined[0].IsClosed:raise ValueError('SLOT join failed')
        return joined[0]
    raise ValueError('Unsupported section '+k)

def mix_section(section,nominal,alpha):
    alpha=max(0.,min(1.,alpha));kind=str(section.get('type','')).upper()
    if kind=='CIRCLE':return {'type':'CIRCLE','diameter_mm':float(section['diameter_mm'])*(1-alpha)+nominal*alpha}
    w=float(section['width_mm']);h=float(section['height_mm'])
    factor=(1-alpha)+alpha*nominal/max(w,h)
    return {'type':kind,'width_mm':w*factor,'height_mm':h*factor}

def profile(meta,d,length):
    start=meta['start_port']['section'];end_port=meta.get('end_port')
    pair=meta.get('route_type')=='PAIR' and end_port is not None
    nominal=float(meta['nominal_diameter_mm'])
    if nominal<=0:raise ValueError('Invalid nominal diameter')
    mode=str(meta.get('profile_mode','NOMINAL')).upper()
    if mode=='LINEAR_TAPER':
        if meta.get('route_type') not in ('PAIR','JUNCTION_BRANCH','JUNCTION_FILLET'):
            raise ValueError('Unsupported Linear Taper route type')
        end=(end_port['section'] if end_port is not None else {'type':'CIRCLE','diameter_mm':nominal})
        if str(start.get('type','')).upper()!='CIRCLE' or str(end.get('type','')).upper()!='CIRCLE':
            raise ValueError('Linear Taper requires circle endpoints')
        a=float(start['diameter_mm']);b=float(end['diameter_mm'])
        return {'type':'CIRCLE','diameter_mm':a+(b-a)*d/length}
    if mode!='NOMINAL':raise ValueError('Unknown profile mode '+mode)
    tr=min(float(meta.get('transition_length_mm',5.0)),length*0.5)
    center={'type':'CIRCLE','diameter_mm':nominal}
    if tr<=1e-9:return center
    if d<tr:return mix_section(start,nominal,d/tr)
    if pair and d>length-tr:return mix_section(end_port['section'],nominal,(length-d)/tr)
    return center

def point_tangent(curve,d,length):
    if d<=0:t=curve.Domain.T0
    elif d>=length:t=curve.Domain.T1
    else:
        ok,t=curve.LengthParameter(d)
        if not ok:raise ValueError('LengthParameter failed')
    return curve.PointAt(t),unit(curve.TangentAt(t))

def profiles_for(curve,meta,spacing):
    length=curve.GetLength()
    if length<=0.01:raise ValueError('Zero length route')
    n=max(4,min(MAX_SECTIONS,int(math.ceil(length/spacing))+1))
    ds=[length*i/float(n-1) for i in range(n)]
    if str(meta.get('profile_mode','NOMINAL')).upper()=='NOMINAL':
        tr=min(float(meta.get('transition_length_mm',5.0)),length*0.5)
        if tr>0.01:ds.extend([tr,length-tr])
    ds=sorted(set(round(d,7) for d in ds))
    prev_t=None;prev_u=None;out=[]
    for d in ds:
        pt,t=point_tangent(curve,d,length)
        if prev_t is None:u=perp(t,meta['start_port'].get('section_u'))
        else:
            rot=rg.Transform.Rotation(prev_t,t,rg.Point3d.Origin)
            u=rg.Vector3d(prev_u);u.Transform(rot);u=perp(t,(u.X,u.Y,u.Z))
        v=unit(rg.Vector3d.CrossProduct(t,u))
        out.append(section_curve(profile(meta,d,length),rg.Plane(pt,u,v)))
        prev_t=t;prev_u=u
    return out

try:
    spacing=2.0 if SectionSpacing is None else float(SectionSpacing)
    if not math.isfinite(spacing) or spacing<=0:raise ValueError('SectionSpacing must be positive')
    curves=[x for x in flatten(RoutedCurves) if isinstance(x,rg.Curve)]
    metadata=[json.loads(x) if isinstance(x,str) else x for x in flatten(RouteMetadata)]
    if len(curves)!=len(metadata):raise ValueError('RoutedCurves/RouteMetadata count mismatch')
    doc=Rhino.RhinoDoc.ActiveDoc;tol=doc.ModelAbsoluteTolerance if doc else 0.01
    skipped=0;branches=0
    for i,(curve,meta) in enumerate(zip(curves,metadata)):
        try:
            route_type=str(meta.get('route_type','')).upper()
            if route_type=='JUNCTION_FILLET':
                skipped+=1
                Report.append('Route {} | Net {} | SKIP JUNCTION_FILLET: use Three-Circle Loft v7 JoinedY'.format(i,meta.get('net_index','?')))
                continue
            sections=profiles_for(curve,meta,spacing)
            SectionCurves.extend(sections)
            breps=rg.Brep.CreateFromLoft(sections,rg.Point3d.Unset,rg.Point3d.Unset,rg.LoftType.Normal,False)
            if not breps:
                Report.append('Route {}: loft failed'.format(i));continue
            brep=breps[0]
            if route_type=='JUNCTION_BRANCH':
                branches+=1
                # Do not cap: the end mouth must remain available to join with JoinedY.
                # Do not extend past the existing trimmed branch curve endpoint.
                end_pt=curve.PointAtEnd
                end_center=rg.AreaMassProperties.Compute(sections[-1])
                center_gap=end_pt.DistanceTo(end_center.Centroid) if end_center else float('nan')
                Report.append('Route {} | Net {} | Y BRANCH ends at trimmed circle | center gap {:.6f} mm | open={}'.format(i,meta.get('net_index','?'),center_gap,not brep.IsSolid))
            else:
                Report.append('Route {} | Net {} | OPEN BOTH ENDS: no planar caps'.format(i,meta.get('net_index','?')))
            ChannelBreps.append(brep)
            Report.append('Route {} | Net {} | {} | nominal Ø{:.3f} | {} sections | closed={}'.format(i,meta.get('net_index','?'),meta.get('profile_mode','NOMINAL'),float(meta['nominal_diameter_mm']),len(sections),brep.IsSolid))
        except Exception as exc:Report.append('Route {}: {}'.format(i,exc))
    Report.append('ALL ROUTES: planar caps disabled; every generated channel loft remains open at both ends.')
    Report.append('Y junction: {} branch lofts, {} fillet routes skipped; JoinedY from Three-Circle Loft v7 is separate.'.format(branches,skipped))
    Report.append('PREVIEW ONLY: Y branch mouths and JoinedY circles not yet geometrically matched or joined; no Boolean/self-intersection validation.')
except Exception as exc:Report.append('ERROR: '+repr(exc))
# ---------- end channel_geometry ----------
panel_13 = Panel(channel_geometry.Report)
y_junction_surface_builder = Python3Script(RoutedCurves=flatten(routing_solver.RoutedCurves), RouteMetadata=flatten(routing_solver.RouteMetadata))  # -> JunctionCircles, LoftPatches, GuideCurves, CapPatches, JoinedY, NakedEdges, Report; inputs RoutedCurves: list, RouteMetadata: list
# ---------- y_junction_surface_builder: Python ----------
# AMCAD Y Three-Circle Loft v7b — complementary semicircle allocation per branch
# Rhino 8 / Grasshopper Python 3
# Inputs: RoutedCurves (List, No Type Hint, Flatten)
#         RouteMetadata (List, No Type Hint, Flatten)
# Outputs: JunctionCircles, LoftPatches, GuideCurves, CapPatches, JoinedY, NakedEdges, Report
# Uses each existing JUNCTION_FILLET Bezier as a centerline rail.
# Does NOT create a watertight Y or guarantee G1 at shared seams.
import Rhino
import Rhino.Geometry as rg
import json, math
JunctionCircles=[]; LoftPatches=[]; GuideCurves=[]; CapPatches=[]; JoinedY=[]; NakedEdges=[]; Report=[]

def flat(x):
    if x is None:return []
    if hasattr(x,'Branches'):return [v for b in x.Branches for v in b]
    return list(x) if isinstance(x,(list,tuple)) else [x]
def unwrap(x):
    if isinstance(x,rg.Curve):return x
    v=getattr(x,'Value',None)
    if isinstance(v,rg.Curve):return v
    f=getattr(x,'ScriptVariable',None)
    if callable(f):
        try:
            v=f()
            if isinstance(v,rg.Curve):return v
        except:pass
    return None
def get_curves():
    a=[unwrap(x) for x in flat(RoutedCurves)]
    if a and all(c is not None for c in a):return a,'Direct curves'
    p=next(p for p in ghenv.Component.Params.Input if p.Name=='RoutedCurves' or p.NickName=='RoutedCurves')
    a=[unwrap(x) for x in p.VolatileData.AllData(True)]
    return a,'GH VolatileData curves: {}'.format(sum(c is not None for c in a))
def decode(x):
    x=getattr(x,'Value',x)
    return json.loads(x) if isinstance(x,str) else x
def unit(v):
    v=rg.Vector3d(v)
    if not v.Unitize():raise ValueError('Zero-length vector')
    return v
def project(v,n):
    v=rg.Vector3d(v);v-=n*(v*n)
    return unit(v) if v.Length>1e-9 else None
def transverse(n,hint):
    v=project(hint,n)
    if v is not None:return v
    for a in (rg.Vector3d.XAxis,rg.Vector3d.YAxis,rg.Vector3d.ZAxis):
        v=project(a,n)
        if v is not None:return v
    raise ValueError('Cannot construct frame')
def circle_point(c,ang):
    return c.Plane.PointAt(c.Radius*math.cos(ang),c.Radius*math.sin(ang))
def halfarc(c,center_angle):
    a=center_angle-math.pi*.5
    return rg.ArcCurve(rg.Arc(circle_point(c,a),circle_point(c,a+math.pi*.5),circle_point(c,a+math.pi)))
def arc_to_neighbor(c,other):
    d=transverse(c.Plane.ZAxis,other-c.Center)
    a=math.atan2(d*c.Plane.YAxis,d*c.Plane.XAxis)
    return halfarc(c,a)
def nearest_on_circle(c,p):
    # Exact closest point on a spatial circle to a given 3D point.
    d=p-c.Center
    x=d*c.Plane.XAxis; y=d*c.Plane.YAxis
    if x*x+y*y<1e-20:return circle_point(c,0.0)
    q=math.atan2(y,x)
    return circle_point(c,q)
def closest_circle_pair(ca,cb):
    # Multistart alternating projections for non-coplanar circle-circle
    # minimum. This finds candidate local minima and selects the shortest.
    best=None
    for i in range(72):
        pa=circle_point(ca,2*math.pi*i/72.0)
        for j in range(60):
            pb=nearest_on_circle(cb,pa)
            pa2=nearest_on_circle(ca,pb)
            if pa.DistanceTo(pa2)<1e-11:
                pa=pa2;break
            pa=pa2
        pb=nearest_on_circle(cb,pa)
        d=pa.DistanceTo(pb)
        if best is None or d<best[0]:best=(d,pa,pb)
    return best
def arc_facing_point(c,p):
    d=unit(p-c.Center)
    a=math.atan2(d*c.Plane.YAxis,d*c.Plane.XAxis)
    return halfarc(c,a)
def tangent_split_arc(circle, split_axis, toward):
    # Split axis is the intersection of the branch section plane and the
    # plane containing the branch tangent, perpendicular to the Y plane.
    # Endpoints are exact antipodes. Choose the half facing this neighbor.
    u=transverse(circle.Plane.ZAxis,split_axis)
    v=unit(rg.Vector3d.CrossProduct(circle.Plane.ZAxis,u))
    direction=project(toward,circle.Plane.ZAxis)
    sign=1 if direction is None or v*direction>=0 else -1
    center=circle.Center;radius=circle.Radius
    return rg.ArcCurve(rg.Arc(center+u*radius,center+v*(sign*radius),center-u*radius)),sign

def y_plane_normal(centers,tangents):
    # Three circle centers define the local Y plane when non-collinear.
    # If near-collinear, infer a best non-degenerate plane from tangent pairs.
    normal=rg.Vector3d.CrossProduct(centers[1]-centers[0],centers[2]-centers[0])
    if normal.Length>1e-8:return unit(normal),'three circle centers'
    candidates=[]
    for i in range(3):
        for j in range(i+1,3):
            n=rg.Vector3d.CrossProduct(tangents[i],tangents[j])
            candidates.append((n.Length,n))
    magnitude,normal=max(candidates,key=lambda x:x[0])
    if magnitude<1e-8:raise ValueError('Y plane undefined: centers and tangents collinear')
    return unit(normal),'branch tangent fallback'

def rotate_to_normal(vec,n0,n1):
    v=rg.Vector3d(vec)
    axis=rg.Vector3d.CrossProduct(n0,n1)
    if axis.Length<1e-10:return v
    axis.Unitize()
    angle=rg.Vector3d.VectorAngle(n0,n1)
    v.Rotate(angle,axis)
    return v
def blend_unit(a,b,f,n):
    # Project a linear interpolation of transported endpoint radial directions.
    v=rg.Vector3d(a)*(1-f)+rg.Vector3d(b)*f
    q=project(v,n)
    if q is not None:return q
    return transverse(n,a)
def arc_section(center,tangent,radius,radial_start,radial_end):
    # Arc endpoints are +/- radial_start; its midpoint is radial_end.
    # Construct a semicircle with the same orientation as its endpoint sections.
    u=transverse(tangent,radial_start)
    v=unit(rg.Vector3d.CrossProduct(tangent,u))
    # Determine which semicircle points toward the interpolated midpoint vector.
    sign=1 if v*radial_end>=0 else -1
    return rg.ArcCurve(rg.Arc(center+u*radius,center+v*(radius*sign),center-u*radius))
def point_close(a,b,tol):
    return a.DistanceTo(b)<=tol

def edge_candidates(breps,tol):
    # Unshared boundary edges of each open loft; exclude section semicircles
    # using the original section circles later.
    result=[]
    for bi,brep in enumerate(breps):
        for e in brep.Edges:
            if e.Valence!=rg.EdgeAdjacency.Naked:continue
            c=e.DuplicateCurve()
            if c and c.GetLength()>tol*2:
                result.append((bi,c))
    return result

def boundary_tangent_mismatch(cap, lofts, tol):
    # Angle between normals at sampled points on the common naked edges.
    # This is a diagnostic, NOT a guarantee of G1 along the full edge.
    values=[]
    for ce in cap.Edges:
        curve=ce.DuplicateCurve()
        for loft in lofts:
            for le in loft.Edges:
                lc=le.DuplicateCurve()
                if (curve.PointAtStart.DistanceTo(lc.PointAtStart)<=tol*5 and
                    curve.PointAtEnd.DistanceTo(lc.PointAtEnd)<=tol*5) or (curve.PointAtStart.DistanceTo(lc.PointAtEnd)<=tol*5 and
                    curve.PointAtEnd.DistanceTo(lc.PointAtStart)<=tol*5):
                    for f in (.2,.5,.8):
                        ok,t=curve.NormalizedLengthParameter(f)
                        if not ok:continue
                        pt=curve.PointAt(t)
                        try:
                            ok1,u1,v1=cap.Faces[0].ClosestPoint(pt)
                            ok2,u2,v2=loft.Faces[0].ClosestPoint(pt)
                            if not (ok1 and ok2):continue
                            n1=cap.Faces[0].NormalAt(u1,v1)
                            n2=loft.Faces[0].NormalAt(u2,v2)
                            if not n1.Unitize() or not n2.Unitize():continue
                            a=math.degrees(rg.Vector3d.VectorAngle(n1,n2))
                            values.append(min(a,180.0-a))
                        except Exception:pass
    return max(values) if values else None,len(values)

def try_tangent_patch(edges, source_lofts, tol):
    # RhinoCommon CreatePatch can use boundary curves and adjacent surfaces
    # as constraints in some Rhino versions; use reflection-safe overload
    # attempts and accept only a valid single Brep. Do not silently claim G1.
    geometry=list(edges)
    # A patch fit is NOT the same as a mathematically exact edge match.
    # We deliberately avoid replacing exact-edge G0 caps with approximate
    # patches until both positional and tangential continuity are measured.
    return None,'Exact boundary preservation prioritized; no verified G1 triangular patch constructor available'

def cap_triangular_holes(lofts,circles,tol):
    # Search 3-edge loops in the naked-edge graph. A cap is valid only when
    # all three edges belong to different lofts and endpoints close within tol.
    # Preserve original NURBS boundary curves exactly (no rebuilding).
    edges=[]
    for bi,c in edge_candidates(lofts,tol):
        if any(c.PointAtStart.DistanceTo(circle.Center)<circle.Radius*1.05 and
               c.PointAtEnd.DistanceTo(circle.Center)<circle.Radius*1.05 and
               abs(c.GetLength()-math.pi*circle.Radius)<max(tol*10,.15)
               for circle in circles):
            continue
        edges.append((bi,c))
    candidates=[]
    for i in range(len(edges)):
        ai,a=edges[i]
        for j in range(i+1,len(edges)):
            bj,b=edges[j]
            if ai==bj:continue
            for k in range(j+1,len(edges)):
                ck,c=edges[k]
                if ck==ai or ck==bj:continue
                # A closed 3-edge chain has six endpoints grouped into
                # three clusters of two. Exhaustively check orientations.
                import itertools
                for flips in itertools.product((False,True),repeat=3):
                    seq=[]
                    for curve,rev in zip((a,b,c),flips):
                        q=curve.DuplicateCurve()
                        if rev:q.Reverse()
                        seq.append(q)
                    if all(point_close(seq[z].PointAtEnd,seq[(z+1)%3].PointAtStart,tol*3)
                           for z in range(3)):
                        candidates.append((i,j,k,seq));break
                if candidates and candidates[-1][:3]==(i,j,k):continue
    used=set();caps=[];notes=[]
    for i,j,k,seq in candidates:
        if any(q in used for q in (i,j,k)):continue
        try:
            surfaces=rg.Brep.CreateEdgeSurface(seq)
            if surfaces is None:notes.append('Triangle ({},{},{}): CreateEdgeSurface failed'.format(i,j,k));continue
            cap=surfaces if isinstance(surfaces,rg.Brep) else list(surfaces)[0]
            if not cap.IsValid:
                notes.append('Triangle ({},{},{}): invalid cap'.format(i,j,k));continue
            # Preserve exact boundary curves: never replace with an unverified
            # approximate fit. Measure whether G1 is already achieved.
            angle,n_samples=boundary_tangent_mismatch(cap,lofts,tol)
            caps.append(cap);used.update((i,j,k))
            if angle is None:
                notes.append('Triangle ({},{},{}): exact-edge G0 cap; G1 measurement unavailable'.format(i,j,k))
            else:
                notes.append('Triangle ({},{},{}): G0 cap; max sampled normal mismatch {:.3f} deg ({} samples)'.format(i,j,k,angle,n_samples))
        except Exception as exc:notes.append('Triangle ({},{},{}): {}'.format(i,j,k,repr(exc)))
    return caps,notes,len(edges),len(candidates)

try:
    curves,src=get_curves();meta=[decode(x) for x in flat(RouteMetadata)]
    Report.append(src)
    if len(curves)!=len(meta) or any(c is None for c in curves):
        raise ValueError('RoutedCurves/RouteMetadata mismatch {} / {}'.format(len(curves),len(meta)))
    nets={}
    for i,(c,m) in enumerate(zip(curves,meta)):
        if m.get('route_type') in ('JUNCTION_BRANCH','JUNCTION_FILLET'):
            nets.setdefault(str(m.get('net_id')),[]).append((i,c,m))
    for net,items in nets.items():
        branches=[x for x in items if x[2].get('route_type')=='JUNCTION_BRANCH']
        fillets=[x for x in items if x[2].get('route_type')=='JUNCTION_FILLET']
        if len(branches)!=3 or len(fillets)!=3:
            Report.append('Net {} skipped: {} branches, {} fillets'.format(net,len(branches),len(fillets)));continue
        centers=[x[1].PointAtEnd for x in branches]
        circles=[]
        tangents=[unit(x[1].TangentAtEnd) for x in branches]
        y_normal,y_source=y_plane_normal(centers,tangents)
        Report.append('Y plane: {} | normal ({:.4f},{:.4f},{:.4f})'.format(y_source,y_normal.X,y_normal.Y,y_normal.Z))
        split_axes=[]
        for k,(idx,c,m) in enumerate(branches):
            t=tangents[k]
            toward=sum((centers[j]-centers[k] for j in range(3) if j!=k),rg.Vector3d(0,0,0))
            u=transverse(t,toward);v=unit(rg.Vector3d.CrossProduct(t,u))
            diameter=float(m.get('nominal_diameter_mm',0))
            if diameter<=0:raise ValueError('Invalid diameter at branch {}'.format(idx))
            circle=rg.Circle(rg.Plane(centers[k],u,v),diameter*.5)
            # Plane through branch endpoint with normal cross(Y-normal,tangent).
            # Intersection with the circular section plane has direction
            # cross(tangent, cross(Y-normal,tangent)), i.e. projected Y-normal.
            split_normal=rg.Vector3d.CrossProduct(y_normal,t)
            if split_normal.Length<1e-8:
                raise ValueError('Branch {} tangent parallel to Y normal: no unique perpendicular split plane'.format(idx))
            split_axis=rg.Vector3d.CrossProduct(t,unit(split_normal))
            split_axis=transverse(t,split_axis)
            split_axes.append(split_axis)
            circles.append(circle);JunctionCircles.append(circle.ToNurbsCurve())
            Report.append('Net {} branch {}: Ø{:.3f}, center ({:.3f},{:.3f},{:.3f})'.format(m.get('net_index','?'),idx,diameter,centers[k].X,centers[k].Y,centers[k].Z))
        # v7b: enumerate all 2^3 complementary assignments, one bit per circle.
        # Each circle appears in two pairs. The first incident pair uses the
        # chosen sign and the second uses its opposite, regardless of fillet order.
        import itertools
        pair_order=((0,1),(1,2),(2,0))
        matched={}
        for idx,rail,m in fillets:
            best=None
            for a,b in pair_order:
                err=rail.PointAtStart.DistanceTo(centers[a])+rail.PointAtEnd.DistanceTo(centers[b])
                if best is None or err<best[0]:best=(err,a,b,False)
                rev=rail.PointAtStart.DistanceTo(centers[b])+rail.PointAtEnd.DistanceTo(centers[a])
                if rev<best[0]:best=(rev,a,b,True)
            error,a,b,rev=best
            if error>0.25:
                Report.append('  Fillet {} endpoint mismatch {:.3f} mm'.format(idx,error));continue
            key=frozenset((a,b))
            if key in matched:
                Report.append('  Duplicate pair {}-{} ignored'.format(a+1,b+1));continue
            cr=rail.DuplicateCurve()
            if rev:cr.Reverse()
            matched[key]=(idx,a,b,cr)
        if len(matched)!=3:
            raise ValueError('Expected 3 unique Y fillet pairs, found {}'.format(len(matched)))
        ordered=[matched[frozenset(pair)] for pair in pair_order]
        # For each circle, its earlier occurrence in pair_order gets the bit.
        first_pair={i:next(j for j,pair in enumerate(pair_order) if i in pair) for i in range(3)}
        def create_candidate(bits):
            lofts=[];guides=[];details=[];twist=0.0
            for pi,(idx,a,b,cr) in enumerate(ordered):
                signs=[];arcs=[]
                for i in (a,b):
                    sign=bits[i] if first_pair[i]==pi else -bits[i]
                    # Explicit sign: avoid neighbor-dependent sign selection.
                    u=transverse(circles[i].Plane.ZAxis,split_axes[i])
                    v=unit(rg.Vector3d.CrossProduct(circles[i].Plane.ZAxis,u))
                    arc=rg.ArcCurve(rg.Arc(centers[i]+u*circles[i].Radius,
                        centers[i]+v*(sign*circles[i].Radius),centers[i]-u*circles[i].Radius))
                    arcs.append(arc);signs.append(sign)
                aa,bb=arcs
                direct=aa.PointAtStart.DistanceTo(bb.PointAtStart)+aa.PointAtEnd.DistanceTo(bb.PointAtEnd)
                reverse=aa.PointAtStart.DistanceTo(bb.PointAtEnd)+aa.PointAtEnd.DistanceTo(bb.PointAtStart)
                if reverse<direct:bb.Reverse()
                n0=unit(cr.TangentAtStart);n1=unit(cr.TangentAtEnd)
                r0=circles[a].Radius;r1=circles[b].Radius
                u0=unit(aa.PointAtStart-centers[a]);u1=unit(bb.PointAtStart-centers[b])
                w0=unit(aa.PointAtNormalizedLength(.5)-centers[a]);w1=unit(bb.PointAtNormalizedLength(.5)-centers[b])
                sections=[aa]
                count=max(5,min(25,int(math.ceil(cr.GetLength()/1.5))+1))
                for k in range(1,count-1):
                    f=float(k)/(count-1)
                    ok,t=cr.NormalizedLengthParameter(f)
                    if not ok:t=cr.Domain.ParameterAt(f)
                    pos=cr.PointAt(t);n=unit(cr.TangentAt(t))
                    v0=rotate_to_normal(u0,n0,n);v1=rotate_to_normal(u1,n1,n)
                    q0=rotate_to_normal(w0,n0,n);q1=rotate_to_normal(w1,n1,n)
                    u=blend_unit(v0,v1,f,n);w=blend_unit(q0,q1,f,n)
                    sections.append(arc_section(pos,n,r0*(1-f)+r1*f,u,w))
                sections.append(bb)
                result=rg.Brep.CreateFromLoft(sections,rg.Point3d.Unset,rg.Point3d.Unset,rg.LoftType.Tight,False)
                if not result or len(result)!=1 or not result[0].IsValid:
                    return None
                lofts.append(result[0]);guides.extend((cr,aa,bb))
                details.append((idx,a,b,signs,count,cr.GetLength()))
                # Large changes in arc midpoint direction penalize twisted lofts.
                twist+=rg.Vector3d.VectorAngle(w0,w1)
            return lofts,guides,details,twist
        doc=Rhino.RhinoDoc.ActiveDoc
        tol=doc.ModelAbsoluteTolerance if doc else .01
        def interior_intersections(lofts):
            # Count crossing curves away from BOTH loft boundaries. Shared seam
            # intersections at naked edges are not interior collisions.
            crossings=0;length=0.0
            for i,j in ((0,1),(1,2),(2,0)):
                result=rg.Intersect.Intersection.BrepBrep(lofts[i],lofts[j],tol)
                if not result:continue
                success,curves,points=result
                if not success:continue
                for c in curves or []:
                    for f in (.25,.5,.75):
                        ok,t=c.NormalizedLengthParameter(f)
                        if not ok:continue
                        pt=c.PointAt(t)
                        def boundary_distance(brep):
                            ds=[]
                            for e in brep.Edges:
                                if e.Valence!=rg.EdgeAdjacency.Naked:continue
                                ok,par=e.ClosestPoint(pt)
                                if ok:ds.append(pt.DistanceTo(e.PointAt(par)))
                            return min(ds) if ds else float('inf')
                        if min(boundary_distance(lofts[i]),boundary_distance(lofts[j]))>tol*5:
                            crossings+=1;length+=c.GetLength()/3.0
                # Isolated crossing points are also suspicious away from seams.
                for pt in points or []:
                    distances=[]
                    for brep in (lofts[i],lofts[j]):
                        d=[]
                        for e in brep.Edges:
                            if e.Valence==rg.EdgeAdjacency.Naked:
                                ok,t=e.ClosestPoint(pt)
                                if ok:d.append(pt.DistanceTo(e.PointAt(t)))
                        distances.append(min(d) if d else float('inf'))
                    if min(distances)>tol*5:crossings+=1
            return crossings,length
        trials=[]
        for bits in itertools.product((-1,1),repeat=3):
            try:
                candidate=create_candidate(bits)
                if candidate is None:
                    Report.append('  Candidate {}: loft failed'.format(bits));continue
                lofts,guides,details,twist=candidate
                crossings,intersection_length=interior_intersections(lofts)
                # Count remaining naked edges after trying the same G0 caps.
                caps0,_,_,_=cap_triangular_holes(lofts,circles,tol)
                shells=list(rg.Brep.JoinBreps(lofts+caps0,tol) or [])
                naked=sum(1 for shell in shells for e in shell.Edges if e.Valence==rg.EdgeAdjacency.Naked)
                score=(crossings,naked,intersection_length,twist)
                trials.append((score,bits,candidate))
                Report.append('  Candidate {}: crossings {}, naked {}, intersection {:.3f} mm, twist {:.2f} rad'.format(bits,crossings,naked,intersection_length,twist))
            except Exception as exc:
                Report.append('  Candidate {} failed: {}'.format(bits,repr(exc)))
        if not trials:raise ValueError('No valid semicircle assignment')
        trials.sort(key=lambda x:x[0])
        score,bits,chosen=trials[0]
        Report.append('  CHOSEN sides {} | crossings {} | naked {}'.format(bits,score[0],score[1]))
        if score[0]>0:Report.append('  WARNING: no collision-free candidate; inspect selected lofts')
        net_loft_start=len(LoftPatches)
        lofts,guides,details,twist=chosen
        LoftPatches.extend(lofts);GuideCurves.extend(guides)
        for idx,a,b,signs,count,rail_length in details:
            Report.append('  Fillet {} pair {}-{}: sides {} / {}, {} Bezier-guided sections, rail {:.3f} mm'.format(idx,a+1,b+1,signs[0],signs[1],count,rail_length))
        # Attempt to close the two triangular holes without changing the
        # proven tangent-plane arc split and Bezier-guided loft construction.
        net_lofts=LoftPatches[net_loft_start:]
        doc=Rhino.RhinoDoc.ActiveDoc
        tol=doc.ModelAbsoluteTolerance if doc else .01
        caps,notes,edge_count,tri_count=cap_triangular_holes(net_lofts,circles,tol)
        CapPatches.extend(caps)
        Report.append('Cap detection: {} non-section naked edges, {} triangle candidates, {} caps'.format(edge_count,tri_count,len(caps)))
        Report.extend('  '+n for n in notes)
        try:
            joined=list(rg.Brep.JoinBreps(net_lofts+caps,tol) or [])
            JoinedY.extend(joined)
            for shell in joined:
                for edge in shell.Edges:
                    if edge.Valence==rg.EdgeAdjacency.Naked:NakedEdges.append(edge.DuplicateCurve())
            Report.append('Join: {} Brep(s), {} naked edges; closed solids {}'.format(len(joined),len(NakedEdges),sum(b.IsSolid for b in joined)))
        except Exception as exc:Report.append('Join failed: '+repr(exc))
        Report.append('G1 STATUS: measured normal-angle mismatch where matching edges were found. No unverified G1/G2 claim; exact G0 caps preserved.')
    if not nets:Report.append('No Y routes found')
except Exception as exc:Report.append('ERROR: '+repr(exc))
# ---------- end y_junction_surface_builder ----------
panel_14 = Panel(y_junction_surface_builder.Report)
brep = Brep(channel_geometry.ChannelBreps)
brep_2 = Brep(y_junction_surface_builder.JoinedY)
hyd_geometry = Python3Script(PreparedCavities=flatten(port_preparation.PreparedCavities), ChannelBreps=flatten(brep), JoinedY=flatten(brep_2))  # -> AssemblyBreps, YAssembly, NakedEdges, Report; inputs PreparedCavities: list, ChannelBreps: list, JoinedY: list
# ---------- hyd_geometry: Python ----------
# AMCAD Final Geometry v2 - Join ALL prepared surfaces
# Rhino 8 / Grasshopper Python 3
# INPUTS (List Access, No Type Hint, Flatten): PreparedCavities, ChannelBreps, JoinedY
# OUTPUTS: AssemblyBreps, YAssembly, NakedEdges, Report
# No Boolean, no cuts, no caps, no tolerance inflation.
import Rhino
import Rhino.Geometry as rg

AssemblyBreps=[]
YAssembly=[]
NakedEdges=[]
Report=[]

def flatten(value):
    if value is None: return []
    if hasattr(value,'Branches'): return [item for branch in value.Branches for item in branch]
    if isinstance(value,(list,tuple)): return [item for part in value for item in flatten(part)]
    return [value]

def unwrap(value):
    for _ in range(6):
        if isinstance(value,(rg.Brep,rg.Extrusion,rg.Surface)): return value
        if hasattr(value,'Value'):
            nxt=value.Value
            if nxt is value: break
            value=nxt
        else: break
    return value

def as_brep(value):
    value=unwrap(value)
    if isinstance(value,rg.Brep): return value.DuplicateBrep()
    if isinstance(value,rg.Extrusion): return value.ToBrep()
    if isinstance(value,rg.Surface): return value.ToBrep()
    return None

def input_breps(name):
    values=flatten(globals().get(name,None))
    found=[b for b in (as_brep(x) for x in values) if b is not None]
    if found: return found,len(values)-len(found)
    try:
        for p in ghenv.Component.Params.Input:
            if p.Name==name:
                values=list(p.VolatileData.AllData(True))
                found=[b for b in (as_brep(x) for x in values) if b is not None]
                return found,len(values)-len(found)
    except Exception as exc: Report.append('{}: volatile data fallback error {}'.format(name,exc))
    return [],len(values)

def naked(brep):
    try: return list(brep.DuplicateNakedEdgeCurves(True,False) or [])
    except Exception: return []

def ncount(breps): return sum(len(naked(b)) for b in breps)
def fcount(breps): return sum(b.Faces.Count for b in breps)
def solids(breps): return sum(1 for b in breps if b.IsSolid)
def summary(label,breps):
    Report.append('{}: {} Brep(s), {} faces, {} naked edge curve(s), {} solid(s)'.format(label,len(breps),fcount(breps),ncount(breps),solids(breps)))

def guarded_join(source,label,tol):
    if not source: return []
    if len(source)==1: return list(source)
    before_faces=fcount(source)
    before_naked=ncount(source)
    try: result=list(rg.Brep.JoinBreps(source,tol) or [])
    except Exception as exc:
        Report.append('{} JOIN ERROR: {}; original Breps retained'.format(label,exc))
        return list(source)
    if not result:
        Report.append('{} JOIN FAILED: original Breps retained'.format(label))
        return list(source)
    after_faces=fcount(result)
    after_naked=ncount(result)
    if after_faces!=before_faces or after_naked>before_naked:
        Report.append('{} JOIN REJECT: faces {} -> {}, naked {} -> {}; originals retained'.format(label,before_faces,after_faces,before_naked,after_naked))
        return list(source)
    Report.append('{} JOIN: {} -> {} Breps | faces {} -> {} | naked {} -> {}'.format(label,len(source),len(result),before_faces,after_faces,before_naked,after_naked))
    if len(result)==len(source): Report.append('{}: no Brep-count reduction; check geometric alignment'.format(label))
    return result

def edge_near_curve(a,b,tol):
    # Diagnostics only. Curves can have different segmentation/parameterization.
    try:
        if abs(a.GetLength()-b.GetLength())>max(5*tol,0.002*max(a.GetLength(),b.GetLength())): return False
        for c,d in ((a,b),(b,a)):
            for frac in (0.0,0.25,0.5,0.75,1.0):
                t=c.Domain.ParameterAt(frac)
                ok,u=d.ClosestPoint(c.PointAt(t))
                if not ok or c.PointAt(t).DistanceTo(d.PointAt(u))>2*tol: return False
        return True
    except Exception: return False

def matching_edge_pairs(cavities,channels,tol):
    # Only full-edge matches; split circular boundaries may not be reported.
    cedges=[];hedges=[]
    for i,b in enumerate(cavities):
        for e in naked(b): cedges.append((i,e))
    for i,b in enumerate(channels):
        for e in naked(b): hedges.append((i,e))
    pairs=[]
    for hi,he in hedges:
        for ci,ce in cedges:
            if edge_near_curve(he,ce,tol): pairs.append((hi,ci))
    return pairs

try:
    doc=Rhino.RhinoDoc.ActiveDoc
    tol=doc.ModelAbsoluteTolerance if doc else 0.01
    Report.append('Final Geometry v2 | document tolerance {:.6f} mm'.format(tol))
    cavities,badc=input_breps('PreparedCavities')
    channels,badh=input_breps('ChannelBreps')
    ys,bady=input_breps('JoinedY')
    Report.append('INPUT: PreparedCavities {} (unresolved {}), ChannelBreps {} (unresolved {}), JoinedY {} (unresolved {})'.format(len(cavities),badc,len(channels),badh,len(ys),bady))
    summary('PREPARED CAVITIES',cavities)
    summary('OPEN CHANNELS',channels)
    summary('Y SHELL',ys)
    if not cavities: Report.append('WARNING: no PreparedCavities resolved')
    if not channels: Report.append('WARNING: no ChannelBreps resolved')
    if not ys: Report.append('WARNING: no JoinedY resolved')

    # Step 1: join the three Y arms to the Y shell, as in v1.
    YAssembly=guarded_join(channels+ys,'Y+CHANNEL',tol)
    summary('Y+CHANNEL RESULT',YAssembly)

    # Diagnostic: look for coincident, complete naked edge pairs across inputs.
    # This is NOT a precondition for joining, because edges can be segmented.
    matches=matching_edge_pairs(cavities,YAssembly,tol)
    Report.append('CAVITY/CHANNEL FULL-EDGE MATCHES (diagnostic): {} pair(s), {} channel component(s), {} cavity surface(s)'.format(len(matches),len(set(x[0] for x in matches)),len(set(x[1] for x in matches))))
    if not matches: Report.append('MATCH NOTE: no full-edge match detected; partial/split edges may still join')

    # Step 2: join ALL already prepared cavity surfaces and open channel/Y surfaces.
    source=list(cavities)+list(YAssembly)
    AssemblyBreps=guarded_join(source,'FINAL ALL-SURFACE',tol)
    summary('FINAL ASSEMBLY',AssemblyBreps)
    for b in AssemblyBreps: NakedEdges.extend(naked(b))
    Report.append('FINAL: {} Breps, {} naked edge curves, {} closed solids'.format(len(AssemblyBreps),len(NakedEdges),solids(AssemblyBreps)))
    Report.append('NO CUT / NO BOOLEAN / NO CAP: existing Port Preparation openings preserved')
    Report.append('CAUTION: JoinBreps proves edge joining only; self-intersections and watertightness are not verified')
except Exception as exc:
    Report.append('ERROR: {}'.format(repr(exc)))
# ---------- end hyd_geometry ----------
panel_15 = Panel(hyd_geometry.Report)
panel_16 = Panel(hyd_geometry.AssemblyBreps)
crv_2 = Curve(hyd_geometry.NakedEdges)
brep_3 = Brep(hyd_geometry.AssemblyBreps)
hyd_wall = Python3Script(AssemblyBreps=flatten(brep_3), WallThickness=Slider(3, range=0..10))  # -> OuterBreps, WallSolids, Report; inputs AssemblyBreps: list, WallThickness: Double; disabled
# ---------- hyd_wall: Python ----------
# AMCAD Wall Geometry v2 — OFFSET ONLY (NO BOOLEAN)
# Rhino 8 / Grasshopper Python 3
# INPUTS: AssemblyBreps (List Access, No Type Hint, Flatten), WallThickness (Item Access, 3.0)
# OUTPUTS: OuterBreps, Report
# WARNING: CreateOffsetBrep itself can be slow on complex Y-junction surfaces.
import Rhino
import Rhino.Geometry as rg
import math

OuterBreps = []
Report = []

def flatten(x):
    if x is None: return []
    if hasattr(x, 'Branches'):
        return [v for branch in x.Branches for v in branch]
    if isinstance(x, (list, tuple)):
        return [v for item in x for v in flatten(item)]
    return [x]

def unwrap(x):
    for _ in range(8):
        if isinstance(x, (rg.Brep, rg.Extrusion)): break
        if not hasattr(x, 'Value'): break
        nxt = x.Value
        if nxt is x: break
        x = nxt
    if isinstance(x, rg.Extrusion): return x.ToBrep()
    return x

def breps_from_result(raw):
    if raw is None: return []
    if isinstance(raw, rg.Brep): return [raw]
    if isinstance(raw, (tuple, list)):
        if len(raw) and isinstance(raw[0], rg.Brep):
            return [x for x in raw if isinstance(x, rg.Brep)]
        if len(raw):
            try: return [x for x in raw[0] if isinstance(x, rg.Brep)]
            except (TypeError, AttributeError): pass
    try: return [x for x in raw if isinstance(x, rg.Brep)]
    except TypeError: return []

try:
    t = float(WallThickness) if WallThickness is not None else 3.0
    if not math.isfinite(t) or t <= 0:
        raise ValueError('WallThickness must be positive')
    doc = Rhino.RhinoDoc.ActiveDoc
    tol = doc.ModelAbsoluteTolerance if doc else 0.001
    inputs = [unwrap(x) for x in flatten(AssemblyBreps)]
    inputs = [x for x in inputs if isinstance(x, rg.Brep)]
    Report.append('WALL v2 | OFFSET ONLY | thickness {:.3f} mm | tol {:.6f} mm'.format(t, tol))
    Report.append('INPUT: {} Brep(s)'.format(len(inputs)))
    if not inputs: raise ValueError('AssemblyBreps is empty')
    for i, inner in enumerate(inputs):
        Report.append('BODY {}: faces={}, closed={}, valid={}'.format(i, inner.Faces.Count, inner.IsSolid, inner.IsValid))
        if not inner.IsSolid or not inner.IsValid:
            Report.append('BODY {} SKIP: requires valid closed Brep'.format(i))
            continue
        # A closed, outward-oriented solid has outward face normals; use positive offset.
        # Reverse orientation when the input solid is inward-oriented.
        orientation = inner.SolidOrientation
        if orientation == rg.BrepSolidOrientation.Inward:
            distance = -t
        elif orientation == rg.BrepSolidOrientation.Outward:
            distance = t
        else:
            Report.append('BODY {} SKIP: solid orientation unknown'.format(i))
            continue
        try:
            raw = rg.Brep.CreateOffsetBrep(inner, distance, False, False, tol)
            pieces = breps_from_result(raw)
            OuterBreps.extend(pieces)
            Report.append('BODY {} OFFSET: signed distance {:+.3f} mm -> {} Brep(s)'.format(i, distance, len(pieces)))
            for j, b in enumerate(pieces):
                Report.append('  piece {}: faces={}, solid={}, valid={}, naked edges={}'.format(
                    j, b.Faces.Count, b.IsSolid, b.IsValid,
                    sum(1 for e in b.Edges if e.Valence == rg.EdgeAdjacency.Naked)))
        except Exception as exc:
            Report.append('BODY {} OFFSET ERROR: {}'.format(i, repr(exc)))
    Report.append('RESULT: {} offset Brep(s); no Boolean, no wall solids'.format(len(OuterBreps)))
    Report.append('NOTE: Offset alone does not verify enclosure, minimum wall thickness, or self-intersections.')
except Exception as exc:
    Report.append('ERROR: {}'.format(repr(exc)))
# ---------- end hyd_wall ----------
panel_17 = Panel(hyd_wall.Report)
brep_4 = Brep(hyd_wall.OuterBreps)
